# Grasshopper definition 5_axis_G_code.gh (Grasshopper 1.0.7)

substrate_brep = Brep(<brep referenced from the Rhino model>)
toolpath = Curve([<curve referenced from the Rhino model> x2])
preview = CustomPreview(Geometry=substrate_brep, Material=ColourSwatch(SwatchColor=RGBA(255, 255, 46, 152)))
path_curve = Curve(graft(toolpath))
# 5axis Kinematics For
# 
# Prusa_5_Axis_Toolchange
# 
# 2021/11/24
panel = Panel(path_curve)
tool_path = ToolPath(curve=path_curve, base_surface=substrate_brep, travel_height=Slider(5, range=0..100))  # -> plane, L, entering_vector, exiting_vector, path_chaning_points, travel_path_length
panel_2 = Panel(tool_path.path_chaning_points)

# ---- group: Extrusion
layer_height = Slider(0.3, range=0..1)
path_width = Slider(0.6, range=0..1)
filament_diameter = Slider(1.75, range=0..10)
c_extrusion = CSharpScript(w=path_width, h=layer_height, d=filament_diameter, x=Slider(1.2, range=0..10), Length=tool_path.L)  # -> out, A; inputs w: Double, h: Double, d: Double, x: Double, Length: Double
# ---------- c_extrusion: C# ----------
    // For calculating the Extrusion amount for given length of segment

    // w = path width
    // h = layer height
    // d = filament diametre
    // x = extrusion multiplier


    double area = ((w - h) * h) + (Math.PI * (Math.Pow(h / 2, 2)));


      A = (area * Length * 4) / (Math.PI * Math.Pow(d, 2) * (1 / x));
# ---------- c_extrusion: C# additional code ----------
  /// <summary>
  /// This method will be called once every solution, before any calls to RunScript.
  /// </summary>
  public override void BeforeRunScript()
  { }
  /// <summary>
  /// This method will be called once every solution, after any calls to RunScript.
  /// </summary>
  public override void AfterRunScript()
  { }
# ---------- end c_extrusion ----------
panel_3 = Panel(c_extrusion.A)

# ----
panel_4 = Panel(tool_path.path_chaning_points)
inverse_kinematics = InverseKinematics(pln=tool_path.plane)  # -> R, acxyz

lng = ListLength(List=tool_path.plane)
multiplication = Multiplication(A=lng, B=Slider(0.422, range=0.001..1))
int = Integer(multiplication)
simulation_item = ListItem(List=inverse_kinematics.R, Index=int, Wrap=True)
simulation = Simulation(
    D=simulation_item,
    crv=path_curve,
    brep=substrate_brep,
    entering_vector=tool_path.entering_vector,
    exiting_vector=tool_path.exiting_vector)

# ---- group: Speed
number_slider = Slider(60, range=0..100)
print_speed_mm_s = Slider(3, range=0..100)
multiplication_2 = Multiplication(A=Slider(0.7, range=0..1), B=number_slider)
multiplication_3 = Multiplication(A=Slider(10, range=0..100), B=number_slider)
speed_compensation = SpeedCompensation(
    acxyz=inverse_kinematics.acxyz,
    extrusion_length=panel_3,
    segment_length=tool_path.L,
    feedrate=multiplication_2,
    travel_speed=multiplication_3,
    travel_path_length=tool_path.travel_path_length,
    patch_chaingin_index=tool_path.path_chaning_points)

# ----
panel_5 = Panel(simulation_item)

c_script = CSharpScript(x=graft(panel_2))  # -> out, A; inputs x: list of Double
# ---------- c_script: C# ----------
    x.Insert(0, x[0] - 1); // add retracting index
    x.Insert(x.Count, x[1] + 1); // add deretracing index   
    // now x[1] is traveling
    
    A = x;
# ---------- end c_script ----------
panel_6 = Panel(c_script.A)
item = ListItem(List=c_script.A, Index=Slider(0, range=0..100), Wrap=True)  # -> flatten(Item)
item_2 = ListItem(List=c_script.A, Index="-1", Wrap=True)  # -> flatten(Item)
panel_7 = Panel(item)
concat = Concatenate(FragmentA="G1 F", FragmentC=Slider(2268, range=0..10000), FragmentB=" E2.1;Filament (De)-Retraction!!")
concat_2 = Concatenate(FragmentA="G1 F", FragmentC=Slider(3010, range=0..10000), FragmentB=" E-2.00 ;Filament Retraction!!")
panel_8 = Panel(concat)
panel_9 = Panel(concat_2)

lng_2 = ListLength(List=panel_7)
series = Series(Start=Slider(2, range=0..10), Step=1, Count=lng_2)
panel_10 = Panel(series)

addition = Addition(A=item_2, B=panel_10)

bang = ExplodeTree(Data=inverse_kinematics.acxyz)  # -> Branch0, Branch1, Branch2, Branch3, Branch4
# Machine OFFSET
# 
# X 144.6
# Y 90.5
panel_11 = Panel(" E")
concat_3 = Concatenate(
    FragmentN="G1 ",
    FragmentM="F",
    FragmentO=speed_compensation,
    FragmentA=" x",
    FragmentF=bang.Branch2,
    FragmentB=" y",
    FragmentG=bang.Branch3,
    FragmentC=" z",
    FragmentH=bang.Branch4,
    FragmentD=" u",
    FragmentI=bang.Branch0,
    FragmentE=" v",
    FragmentJ=bang.Branch1,
    FragmentK=panel_11,
    FragmentL=panel_3)  # -> simplify(flatten(Result))
panel_12 = Panel("""; START Prusa 5_axis G-code
; We assume that machine is not stopped from planar construction


G90 ; use absolute coordinates


G0 Z80;


M104 S220 ; set extruder temp
M109 S220 ; wait for extruder temp
G21 ; set units to millimeters

G1 u0.1 v0.1; Give a little kick to A and B motor
G1 u0 v0 ;


G90 ; use absolute coordinates
M83 ; use relative distances for extrusion

M98 P"/macros/move_to_mid.g" ;move the nozzle to centre


G1 E5.0 ; initial extrusion""")
panel_13 = Panel("""; END G-CODE
G1 E-1
M104 S0 ; turn off temperature
G0 Z80 ; move the head up""")

ins_retraction = InsertItems(List=concat_3, Item=panel_9, Indices=item, Wrap=True)  # -> flatten(List)
ins_deretraction = InsertItems(List=ins_retraction, Item=panel_8, Indices=addition, Wrap=True)  # -> flatten(List)

merge = Merge(Data1=flatten(panel_12), Data2=ins_deretraction, Data3=flatten(panel_13))
panel_14 = Panel(merge)

# ==== cluster ToolPath
base_surface = ClusterInput()  # Base Surface
curve = ClusterInput()  # Curve
len = Length(Curve=curve)
panel = Panel(curve)
division = Division(A=len, B=Slider(0.2, range=0..5))
travel_height = ClusterInput()
brep = Brep(base_surface)

# ---- group: Curve Into Plane
disc = Discontinuity(Curve=curve, Level=1)  # -> Points, Parameters
divide = DivideCurve(Curve=curve, Count=division, Kinks=False)  # -> Points, Tangents, Parameters
merge = Merge(Data1=disc.Points, Data2=divide.Points)
duppt = RemoveDuplicatePts(Points=merge, Tolerance=0.01)
simplify = SimplifyTree(Tree=duppt, Front=False)
alongcrv = SortAlongCurve(Points=simplify, Curve=curve)  # -> Points, Indices
pl = ConstructPlane(Origin=alongcrv.Points, XAxis=Vector(1, 0, 0), YAxis=Vector(0, 1, 0))  # -> simplify(Plane)

# ---- group: Entering Path / Starting Point
item = ListItem(List=pl, Index=0, Wrap=True)

# ---- group: Entering Path
brep_cp = BrepClosestPoint(Point=item, Brep=brep)  # -> Point, Normal, Distance
amp = Amplitude(Vector=brep_cp.Normal, Amplitude=travel_height)
approaching_point = Move(Geometry=item, Motion=amp)  # -> Geometry, Transform
vec2pt = Vector2Pt(PointA=approaching_point.Geometry, PointB=brep_cp.Point, Unitize=False)  # -> Vector, Length
approaching_vector = VectorDisplay(Anchor=approaching_point.Geometry, Vector=vec2pt.Vector)

# ----
panel_2 = Panel(approaching_point.Geometry)
panel_3 = Panel(pl)

# ---- group: Add Entering Path
ins = InsertItems(List=pl, Item=approaching_point.Geometry, Indices=Slider(0, range=0..100), Wrap=True)

# ----
lng = ListLength(List=pl)
addition = Addition(A=lng, B=Slider(1, range=0..1))
panel_4 = Panel(addition)
number_slider = Slider(0, range=0..100)

num = Number(flatten(addition))
addition_2 = Addition(A=num, B=Slider(1, range=0..1))
ma = MassAddition(Input=addition_2)  # -> Result, PartialResults
lng_2 = ListLength(List=ma.PartialResults)
subtraction = Subtraction(A=lng_2, B=Slider(1, range=0..1))
cull_i = CullIndex(List=ma.PartialResults, Indices=subtraction, Wrap=True)
path_chaning_points = ClusterOutput(cull_i)

entwine = Entwine(Branch00=item, Branch01=vec2pt.Vector, FlattenInputs=True)
entering_vector = ClusterOutput(entwine)
panel_5 = Panel(ma.PartialResults)

# ---- group: Exiting_Path
number_slider_2 = Slider(-1, range=-1..1)

# ---- group: Exiting_Path / Ending Point
item_2 = ListItem(List=pl, Index=number_slider_2, Wrap=True)

# ---- group: Exiting_Path (continued)
brep_cp_2 = BrepClosestPoint(Point=item_2, Brep=brep)  # -> Point, Normal, Distance
amp_2 = Amplitude(Vector=brep_cp_2.Normal, Amplitude=travel_height)
exiting_point = Move(Geometry=item_2, Motion=amp_2)  # -> Geometry, Transform
vec2pt_2 = Vector2Pt(PointA=item_2, PointB=exiting_point.Geometry, Unitize=False)  # -> Vector, Length
approaching_vector_2 = VectorDisplay(Anchor=item_2, Vector=vec2pt_2.Vector)

# ---- group: Add Exiting_Path
ins_2 = InsertItems(List=ins, Item=exiting_point.Geometry, Indices=Slider(-1, range=-1..1), Wrap=True)

# ----
ln = Line(StartPoint=approaching_point.Geometry, EndPoint=exiting_point.Geometry)
brep_cp_3 = BrepClosestPoint(Point=ins_2, Brep=base_surface)  # -> Point, Normal, Distance
len_2 = Length(Curve=ln)
padjust = AdjustPlane(Plane=ins_2, Normal=brep_cp_3.Normal)  # -> flatten(Plane)
travel_path_legth = Panel(len_2)
item_3 = ListItem(List=padjust, Index=Slider(0, range=0..10000), Wrap=True)
points = PointList(Points=item_3, Size=Slider(0.1, range=0..1))
entwine_2 = Entwine(Branch00=item_2, Branch01=vec2pt_2.Vector, FlattenInputs=True)
exiting_vector = ClusterOutput(entwine_2)
travel_path_length = ClusterOutput(len_2)
plane = ClusterOutput(padjust)

# ---- group: Segment Length
pline = PolyLine(Vertices=ins_2, Closed=False)
explode = Explode(Curve=pline, Recursive=True)  # -> Segments, Vertices

# ----
replace = ReplaceItems(List=explode.Segments, Item=number_slider, Indices=number_slider, Wrap=False)
replace_2 = ReplaceItems(List=replace, Item=number_slider, Indices="-1", Wrap=True)
panel_6 = Panel(replace_2)

# ---- group: Segment Length (continued)
len_3 = Length(Curve=replace_2)  # -> simplify(Length)

# ----
nullrep = ReplaceNulls(Items=len_3, Replacements=Slider(0, range=0..100))  # -> Items, Count

# ---- group: Segment Length (continued)
ins_3 = InsertItems(List=nullrep.Items, Item="0", Indices="0", Wrap=True)  # -> flatten(List)

# ----
panel_7 = Panel(ins_3)
L = ClusterOutput(ins_3)

# ==== cluster InverseKinematics
pln = ClusterInput()
pln_2 = Plane(pln)
deplane = DeconstructPlane(Plane=pln_2)  # -> Origin, XAxis, YAxis, ZAxis
panel = Panel(deplane.ZAxis)
points = PointList(Points=deplane.Origin, Size=Slider(1, range=0..10))
position = Panel(deplane.Origin)
xz = XZPlane(Origin=Point(0, 0, 0))
number_slider = Slider(100, range=0..100)

# ----
# C axis angle
devec = DeconstructVector(Vector=deplane.ZAxis)  # -> XComponent, YComponent, ZComponent
num = Number(devec.XComponent)
num_2 = Number(devec.YComponent)
expression = Expression(x=num, y=num_2, Expression="Atan2(y,x)")
neg = Negative(Value=expression)
deg = Degrees(Radians=neg)

cluster = Cluster(radian=neg)  # -> pr, L
panel_2 = Panel(deg)
panel_3 = Panel(cluster.pr)
subtraction = Subtraction(A=panel_2, B=panel_3)
round = Round(Number=subtraction)  # -> Nearest, Floor, Ceiling
panel_4 = Panel(round.Nearest)

# ----
# A axis angle
devec_2 = DeconstructVector(Vector=deplane.ZAxis)  # -> XComponent, YComponent, ZComponent
xy = XYPlane(Origin=Point(0, 0, 0))

c_script = CSharpScript(x=devec_2.ZComponent)  # -> out, A; inputs x: list of Double
# ---------- c_script: C# ----------
    for(int i = 0; i < x.Count; i++){
      if(x[i] == -1){
        x[i] = 1;
      }
    }
    
      A = x;
# ---------- end c_script ----------

acos = ArcCosine(Value=c_script.A)
multiplication = Multiplication(A=acos)
deg_2 = Degrees(Radians=multiplication)
rotate = Rotate(Geometry=xy, Angle=acos, Plane=xz)  # -> Geometry, Transform

panel_5 = Panel(c_script.A)

rad = Radians(Degrees=cluster.pr)
rotate_2 = Rotate(Geometry=rotate.Geometry, Angle=rad, Plane=rotate.Geometry)  # -> Geometry, Transform

# ----
# X Y Z coordinates
transform = Transform(Geometry=pln_2, Transform=rotate.Transform)
transform_2 = Transform(Geometry=transform, Transform=rotate_2.Transform)
plcoord = PlaneCoordinates(Point=transform_2, System=PlaneXY(0, 0, 0))  # -> XCoordinate, YCoordinate, ZCoordinate

panel_6 = Panel(deg_2)
neg_2 = Negative(Value=plcoord.YCoordinate)
gcode_entwine_position_and_orientation = Entwine(
    Branch00=deg_2,
    Branch01=cluster.pr,
    Branch02=plcoord.XCoordinate,
    Branch03=plcoord.YCoordinate,
    Branch04=plcoord.ZCoordinate,
    FlattenInputs=True)
simulation_entwine_matrix = Entwine(
    Branch00=rotate.Transform,
    Branch01=rotate_2.Transform,
    Branch02=plcoord.XCoordinate,
    Branch03=plcoord.YCoordinate,
    Branch04=plcoord.ZCoordinate,
    FlattenInputs=True)
R = ClusterOutput(simulation_entwine_matrix)
multiplication_2 = Multiplication(A=gcode_entwine_position_and_orientation, B=number_slider)
int = Integer(multiplication_2)
division = Division(A=int, B=number_slider)
acxyz = ClusterOutput(division)

# ==== cluster SpeedCompensation
acxyz = ClusterInput()  # ACXYZ
reldif = RelativeDifferences(Values=acxyz)
feedrate = ClusterInput()
segment_length = ClusterInput()
extrusion_length = ClusterInput()
patch_chaingin_index = ClusterInput()
travel_path_length = ClusterInput()
travel_speed = ClusterInput()
bang = ExplodeTree(Data=reldif)  # -> Branch0, Branch1, Branch2, Branch3, Branch4
num = Number(extrusion_length)
num_2 = Number(segment_length)

# ---- group: Travel Path Length
num_3 = Number(flatten(travel_path_length))
travel_path_length_2 = Panel(num_3)

# ----
num_4 = Number(patch_chaingin_index)
panel = Panel(num)
path_changing_index = Panel(num_4)
# Microstep
# X16 Y16 Z16 E32 A16 C16
# 
# Steps/mm
# X100 Y100 Z400 E280
# 
# Steps/deg
# A26.667 C17.778
panel_2 = Panel(bang.Branch4)
c_script = CSharpScript(a=bang.Branch0, c=bang.Branch1, x=bang.Branch2, y=bang.Branch3, z=bang.Branch4, e=num)  # -> out, D; inputs a: Double, c: Double, x: Double, y: Double, z: Double, e: Double
# ---------- c_script: C# ----------
    double As; //square of a axis differences
    double Cs;
    double Xs;
    double Ys;
    double Zs;
    double Es;

    As = Math.Pow(a, 2);
    Cs = Math.Pow(c, 2);
    Xs = Math.Pow(x, 2);
    Ys = Math.Pow(y, 2);
    Zs = Math.Pow(z, 2);
    Es = Math.Pow(e, 2);
    
    D = Math.Sqrt(As + Cs + Xs + Ys + Zs +Es);
# ---------- end c_script ----------
euclidian_distance_mm = Panel(c_script.D)
retraction_speed_index = CSharpScript(x=panel)  # -> out, Index; inputs x: list of Double
# ---------- retraction_speed_index: C# ----------
    List<double> index = new List<double>();
    // List<double> rotation = new List<double>();

    for(int i = 0; i < x.Count; i++){

      if(x[i] == 0 || x[i] == 1 ){ // FIND ENTERING AND EXITTING

        index.Add(i);
      }

    }

    Index = index;
# ---------- end retraction_speed_index ----------
item = ListItem(List=c_script.D, Index=path_changing_index, Wrap=True)
division = Division(A=c_script.D, B=num_2)
travel_path_euclidiean = Panel(item)
panel_3 = Panel(retraction_speed_index.Index)
speed_compensation_ratio = Panel(division)
division_2 = Division(A=item, B=path_changing_index)
multiplication = Multiplication(A=division, B=feedrate)
new_sped_mm_min = Panel(multiplication)
division_3 = Division(A=euclidian_distance_mm, B=new_sped_mm_min)
panel_4 = Panel(division_3)
panel_5 = Panel(division_2)
maximum_feedrate_over_ride = CSharpScript(x=multiplication)  # -> out, A; inputs x: list of Double
# ---------- maximum_feedrate_over_ride: C# ----------
    //M203 X12000.00 Y12000.00 Z750.00 E1500.00 A5000.00 C5000.00

    for (int i = 0; i < x.Count; i++){

      if(x[i] > 9000){
        x[i] = 9000;
      }

      A = x;
    }
# ---------- end maximum_feedrate_over_ride ----------
multiplication_2 = Multiplication(A=travel_speed, B=division_2)
# M203 X12000.00 Y12000.00 Z750.00 E1500.00 A5000.00 C12000.00  	    ; Set maximum speeds (mm/min)
ma = MassAddition(Input=panel_4)  # -> Result, PartialResults
panel_6 = Panel(ma.Result)
replace = ReplaceItems(List=maximum_feedrate_over_ride.A, Item=multiplication_2, Indices=path_changing_index, Wrap=False)
replace_2 = ReplaceItems(List=replace, Item=travel_speed, Indices=panel_3, Wrap=False)
c_script_2 = CSharpScript(D=c_script.D, F=replace_2, a=bang.Branch0, c=bang.Branch1, x=bang.Branch2, y=bang.Branch3, z=bang.Branch4, e=num)  # -> out, Af, Cf, Xf, Yf, Zf, Ef; inputs D: Double, F: Double, a: Double, c: Double, x: Double, y: Double, z: Double, e: Double
# ---------- c_script_2: C# ----------
    double Time; // time for each line of G-code (Min)

    Time = D / F;


    Af = Math.Abs(a / Time);
    Cf = Math.Abs(c / Time);
    Xf = Math.Abs(x / Time);
    Yf = Math.Abs(y / Time);
    Zf = Math.Abs(z / Time);
    Ef = Math.Abs(e / Time);
# ---------- end c_script_2 ----------
panel_7 = Panel(c_script_2.Yf)
feed_mm_min = Panel(c_script_2.Ef)
panel_8 = Panel(c_script_2.Af)
panel_9 = Panel(replace_2)
division_4 = Division(A=panel_8, B=Slider(60, range=0..100))
panel_11 = Panel(division_4)

min_max_index = CSharpScript(
    x=c_script_2.Cf,
    Reference=["C:\Program Files (x86)\Microsoft.NET\Primary Interop Assemblies\adodb.dll", "C:\Program Files (x86)\Microsoft.NET\Primary Interop Assemblies\Microsoft.mshtml.dll", "C:\Program Files (x86)\Microsoft.NET\Primary Interop Assemblies\Microsoft.stdformat.dll", "C:\Program Files (x86)\Microsoft.NET\Primary Interop Assemblies\msdatasrc.dll", "C:\Program Files (x86)\Microsoft.NET\Primary Interop Assemblies\stdole.dll"])  # -> out, A, i, B; inputs x: list of Double
# ---------- min_max_index: C# usings ----------
using System.Linq;
# ---------- min_max_index: C# ----------
    for (int j = 0; j < x.Count; j++){
      for (int k = 0; k < x.Count; k++){

        bool res = Double.IsNaN(x[j]);
        if (res){
          x.Remove(x[j]);
        }

        else if (x[k] == 0){
          x.Remove(x[k]);
        }
      }
    }

    double maxValue = x.Max();
    double minValue = x.Min();
    double minIndex = x.ToList().IndexOf(minValue);


    A = maxValue;
    i = minIndex;
    B = minValue;
# ---------- end min_max_index ----------
index_of_min_value = Panel(min_max_index.i)
min_value = Panel(min_max_index.B)
max_value = Panel(min_max_index.A)

# ----
# Speed of Each Axis
min_max_index_2 = CSharpScript(
    x=c_script_2.Af,
    Reference=["C:\Program Files (x86)\Microsoft.NET\Primary Interop Assemblies\adodb.dll", "C:\Program Files (x86)\Microsoft.NET\Primary Interop Assemblies\Microsoft.mshtml.dll", "C:\Program Files (x86)\Microsoft.NET\Primary Interop Assemblies\Microsoft.stdformat.dll", "C:\Program Files (x86)\Microsoft.NET\Primary Interop Assemblies\msdatasrc.dll", "C:\Program Files (x86)\Microsoft.NET\Primary Interop Assemblies\stdole.dll"])  # -> out, A, i, B; inputs x: list of Double; same code as min_max_index
max_value_2 = Panel(min_max_index_2.A)
index_of_min_value_2 = Panel(min_max_index_2.i)
min_value_2 = Panel(min_max_index_2.B)

min_max_index_3 = CSharpScript(
    x=c_script_2.Xf,
    Reference=["C:\Program Files (x86)\Microsoft.NET\Primary Interop Assemblies\adodb.dll", "C:\Program Files (x86)\Microsoft.NET\Primary Interop Assemblies\Microsoft.mshtml.dll", "C:\Program Files (x86)\Microsoft.NET\Primary Interop Assemblies\Microsoft.stdformat.dll", "C:\Program Files (x86)\Microsoft.NET\Primary Interop Assemblies\msdatasrc.dll", "C:\Program Files (x86)\Microsoft.NET\Primary Interop Assemblies\stdole.dll"])  # -> out, A, i, B; inputs x: list of Double; same code as min_max_index
index_of_min_value_3 = Panel(min_max_index_3.i)
max_value_3 = Panel(min_max_index_3.A)
min_value_3 = Panel(min_max_index_3.B)

min_max_index_4 = CSharpScript(
    x=c_script_2.Yf,
    Reference=["C:\Program Files (x86)\Microsoft.NET\Primary Interop Assemblies\adodb.dll", "C:\Program Files (x86)\Microsoft.NET\Primary Interop Assemblies\Microsoft.mshtml.dll", "C:\Program Files (x86)\Microsoft.NET\Primary Interop Assemblies\Microsoft.stdformat.dll", "C:\Program Files (x86)\Microsoft.NET\Primary Interop Assemblies\msdatasrc.dll", "C:\Program Files (x86)\Microsoft.NET\Primary Interop Assemblies\stdole.dll"])  # -> out, A, i, B; inputs x: list of Double; same code as min_max_index
index_of_min_value_4 = Panel(min_max_index_4.i)
max_value_4 = Panel(min_max_index_4.A)
min_value_4 = Panel(min_max_index_4.B)

min_max_index_5 = CSharpScript(
    x=c_script_2.Zf,
    Reference=["C:\Program Files (x86)\Microsoft.NET\Primary Interop Assemblies\adodb.dll", "C:\Program Files (x86)\Microsoft.NET\Primary Interop Assemblies\Microsoft.mshtml.dll", "C:\Program Files (x86)\Microsoft.NET\Primary Interop Assemblies\Microsoft.stdformat.dll", "C:\Program Files (x86)\Microsoft.NET\Primary Interop Assemblies\msdatasrc.dll", "C:\Program Files (x86)\Microsoft.NET\Primary Interop Assemblies\stdole.dll"])  # -> out, A, i, B; inputs x: list of Double; same code as min_max_index
max_value_5 = Panel(min_max_index_5.A)
index_of_min_value_5 = Panel(min_max_index_5.i)
min_value_5 = Panel(min_max_index_5.B)

feedrate_2 = ClusterOutput(replace_2)

# ==== cluster Simulation
D = ClusterInput()
entering_vector = ClusterInput()
exiting_vector = ClusterInput()
bang = ExplodeTree(Data=D)  # -> Branch0, Branch1, Branch2, Branch3, Branch4
X = Panel(bang.Branch2)
A = Panel(bang.Branch0)
C = Panel(bang.Branch1)
Z = Panel(bang.Branch4)
Y = Panel(bang.Branch3)
neg = Negative(Value=bang.Branch3)
brep = ClusterInput()
crv = ClusterInput()
path = FilePath("C:\Users\Freddie Hong\OneDrive - Imperial College London\Imperial\Freddie Hong_PhD\Document\Submission\5_axis_3D printing\3.Machine 3D file\0803_Prusa_5axis_profile_v2.3dm")
brep_2 = Brep(graft(brep))
crv_2 = Curve(flatten(crv))

# ----
# X  Axis Orientation
path_2 = FilePath("C:\Users\Freddie Hong\OneDrive - Imperial College London\Imperial\Freddie Hong_PhD\Document\Submission\5_axis_3D printing\3.Machine 3D file\0.4mm_nonPlanar.3dm")
X_2 = UnitX(Factor=bang.Branch2)
_3dm = Import3DM(File=path_2, Layer="*", Name="*")
move = Move(Geometry=_3dm, Motion=X_2)  # -> Geometry, Transform

# ----
# Z  Axis Orientation
Z_2 = UnitZ(Factor=bang.Branch4)
move_2 = Move(Geometry=move.Geometry, Motion=Z_2)  # -> Geometry, Transform
preview = CustomPreview(Geometry=move_2.Geometry, Material=ColourSwatch(SwatchColor=RGBA(131, 172, 200, 157)))

Y_2 = UnitY(Factor=neg)

# ---- group: Curve Inversed Path
# Stock Orientation
group = Group(Objects=[crv_2, brep_2])
transform = Transform(Geometry=group, Transform=bang.Branch0)
transform_2 = Transform(Geometry=transform, Transform=bang.Branch1)
move_3 = Move(Geometry=transform_2, Motion=Y_2)  # -> flatten(Geometry), Transform

# ----
comp = Compound(Transforms=flatten([bang.Branch0, bang.Branch1]))

# ----
# C Axis Orientation
panel = Panel("C-30")
_3dm_2 = Import3DM(File=path, Layer=panel, Name="*")
transform_c = Transform(Geometry=_3dm_2, Transform=comp)
move_4 = Move(Geometry=transform_c, Motion=Y_2)  # -> Geometry, Transform
preview_2 = CustomPreview(Geometry=move_4.Geometry, Material=ColourSwatch(SwatchColor=RGBA(155, 217, 200, 157)))

panel_2 = Panel(group)

bang_2 = ExplodeTree(Data=exiting_vector)  # -> Branch0, Branch1
bang_3 = ExplodeTree(Data=entering_vector)  # -> Branch0, Branch1
transform_3 = Transform(Geometry=bang_3.Branch0, Transform=bang.Branch0)
transform_4 = Transform(Geometry=bang_2.Branch0, Transform=bang.Branch0)
transform_5 = Transform(Geometry=transform_3, Transform=bang.Branch1)
transform_6 = Transform(Geometry=transform_4, Transform=bang.Branch1)
move_5 = Move(Geometry=transform_5, Motion=Y_2)  # -> Geometry, Transform
move_6 = Move(Geometry=transform_6, Motion=Y_2)  # -> Geometry, Transform
rev = Reverse(Vector=bang_3.Branch1)
rev_2 = Reverse(Vector=bang_2.Branch1)
move_7 = Move(Geometry=move_5.Geometry, Motion=rev)  # -> Geometry, Transform
move_8 = Move(Geometry=move_6.Geometry, Motion=rev_2)  # -> Geometry, Transform
ln = Line(StartPoint=move_7.Geometry, EndPoint=move_5.Geometry)
ln_2 = Line(StartPoint=move_8.Geometry, EndPoint=move_6.Geometry)
number_slider = Slider(5, range=0..10)
vdisex = VectorDisplayEx(Point=move_7.Geometry, Vector=ln, Colour=ColourSwatch(SwatchColor=RGBA(255, 0, 50, 91)), Width=number_slider)
vdisex_2 = VectorDisplayEx(Point=move_6.Geometry, Vector=ln_2, Colour=ColourSwatch(SwatchColor=RGBA(55, 240, 202, 91)), Width=number_slider)

dispatch = Dispatch(List=move_3.Geometry, DispatchPattern=[True, False])  # -> ListA, ListB
preview_3 = CustomPreview(Geometry=dispatch.ListB, Material=ColourSwatch(SwatchColor=RGBA(255, 255, 255, 110)))
preview_4 = CustomPreview(Geometry=dispatch.ListA, Material=ColourSwatch(SwatchColor=RGB(0, 0, 255)))

# ----
# A Axis Orientation
panel_3 = Panel("A")
_3dm_3 = Import3DM(File=path, Layer=panel_3, Name="*")

transform_a = Transform(Geometry=_3dm_3, Transform=bang.Branch0)
move_9 = Move(Geometry=transform_a, Motion=Y_2)  # -> Geometry, Transform

preview_5 = CustomPreview(Geometry=move_9.Geometry, Material=ColourSwatch(SwatchColor=RGBA(255, 157, 200, 157)))

# ----
# Y Axis Orientation
panel_4 = Panel("Y")
_3dm_4 = Import3DM(File=path, Layer=panel_4, Name="*")

move_10 = Move(Geometry=_3dm_4, Motion=Y_2)  # -> Geometry, Transform

preview_6 = CustomPreview(Geometry=move_10.Geometry, Material=ColourSwatch(SwatchColor=RGBA(255, 255, 188, 71)))

# ==== cluster Cluster
radian = ClusterInput()
deg = Degrees(Radians=radian)

# ---- group: Relative Mode Caxis
reldif = RelativeDifferences(Values=radian)
panel = Panel(reldif)
item = ListItem(List=deg, Index=0, Wrap=True)

# ----
deg_2 = Degrees(Radians=panel)
panel_2 = Panel(deg_2)

# ---- group: Relative Mode Caxis / Takes Shortest Rotation
sin = Sine(Value=panel)
asin = ArcSine(Value=sin)
deg_3 = Degrees(Radians=asin)

# ----
c_90_degree_rotation_condition = CSharpScript(x=panel)  # -> out, Rotation, Index; inputs x: list of Double
# ---------- c_90_degree_rotation_condition: C# ----------
    List<double> index = new List<double>();
    List<double> rotation = new List<double>();


    for(int i = 0; i < x.Count; i++){

      if(x[i] < Math.PI && x[i] > Math.PI / 2){
        rotation.Add(x[i]);
        index.Add(i);
      }
      else if(x[i] > -Math.PI && x[i] < -Math.PI / 2){
        rotation.Add(x[i]);
        index.Add(i);
      }
    }
    Rotation = rotation;
    Index = index;
# ---------- end c_90_degree_rotation_condition ----------
deg_4 = Degrees(Radians=c_90_degree_rotation_condition.Rotation)
panel_3 = Panel(deg_4)
panel_4 = Panel(c_90_degree_rotation_condition.Index)

c_180_degree_rotation_condition = CSharpScript(x=panel)  # -> out, Rotation, Index; inputs x: list of Double
# ---------- c_180_degree_rotation_condition: C# ----------
    List<double> index = new List<double>();
    List<double> rotation = new List<double>();

    //if (1 <= x && x <= 100)
    // take in Radian
    for(int i = 0; i < x.Count; i++){

      if(Math.PI - 1 <= x[i] && x[i] <= Math.PI + 1){
        rotation.Add(x[i]); //output Degree
        index.Add(i);
      }
      else if(-Math.PI - 1 <= x[i] && x[i] <= -Math.PI + 1){
        rotation.Add(x[i]); //ouput degree
        index.Add(i);
      }
    }
    Rotation = rotation;
    Index = index;
# ---------- end c_180_degree_rotation_condition ----------
panel_5 = Panel(c_180_degree_rotation_condition.Rotation)
panel_6 = Panel(c_180_degree_rotation_condition.Index)

deg_5 = Degrees(Radians=c_180_degree_rotation_condition.Rotation)

# ---- group: Relative Mode Caxis (continued)
replace = ReplaceItems(List=deg_3, Item=item, Indices=Slider(0, range=0..100), Wrap=False)

# ----
replace_2 = ReplaceItems(List=replace, Item=deg_5, Indices=c_180_degree_rotation_condition.Index, Wrap=False)

panel_7 = Panel(replace_2)
replace_3 = ReplaceItems(List=replace_2, Item=panel_3, Indices=panel_4, Wrap=False)

# ---- group: Relative Mode Caxis (continued)
panel_8 = Panel(replace_3)
ma = MassAddition(Input=panel_8)  # -> Result, PartialResults

# ----
panel_9 = Panel(replace_3)
L = ClusterOutput(replace_3)
deg_6 = Degrees(Radians=ma.PartialResults)
pr = ClusterOutput(ma.PartialResults)
panel_10 = Panel(ma.PartialResults)
