# Grasshopper definition 5_axis_Toolpath.gh (Grasshopper 1.0.7)
# Copyright: Freddie Hong

number_of_perimeters = Slider(5, range=0..10)
layer_height = Slider(0.23, range=0..1)
path_width = Slider(0.41, range=0..1)
layer_numbers = Slider(2, range=0..10)
infill_direction = Slider(80, range=0..1000)
brep = Brep(<brep referenced from the Rhino model>)
cluster_version2_2dplane_offset = Cluster_Version2_2dplaneOffset(
    surface=brep,
    layer_height=layer_height,
    layer_numbers=layer_numbers,
    relay_2=path_width,
    relay=number_of_perimeters,
    D=infill_direction)
crv = Curve(cluster_version2_2dplane_offset)
preview = CustomPreview(Geometry=crv, Material=ColourSwatch(SwatchColor=RGB(9, 0, 255)))

# ==== cluster Cluster_Version2_2dplaneOffset
D = ClusterInput()
layer_numbers = ClusterInput()
layer_height = ClusterInput()
surface = ClusterInput()
relay = ClusterInput()
relay_2 = ClusterInput()
preview = CustomPreview(Geometry=surface, Material=ColourSwatch(SwatchColor=RGBA(235, 255, 255, 161)))
edges = BrepEdges(Brep=surface)  # -> Naked, Interior, NonManifold
subtraction = Subtraction(A=relay, B="1")
division = Division(A=relay_2, B="2")
join = JoinCurves(Curves=edges.Naked, Preserve=False)
series = Series(Start=relay_2, Step=relay_2, Count=subtraction)
offsets = OffsetOnSrf(Curve=join, Distance=division, Surface=surface)
offsets_2 = OffsetOnSrf(Curve=offsets, Distance=series, Surface=surface)  # -> flatten(Curve)
multiplication = Multiplication(A=relay_2, B=relay)
addition = Addition(A=multiplication, B=division)
item = ListItem(List=offsets_2, Index="-1", Wrap=True)
offsets_3 = OffsetOnSrf(Curve=join, Distance=addition, Surface=surface)
Z = UnitZ(Factor=Slider(40, range=0..1000))

# ---- group: Top down projection
project = Project(Geometry=offsets_3, Plane=Z)  # -> Geometry, Transform
bbox = BoundingBox(Content=project.Geometry, Plane=PlaneXY(0, 0, 0))  # -> Box, Box_2
wires = BrepWireframe(Brep=bbox.Box, Density=-1)  # -> flatten(Wireframe)
join_2 = JoinCurves(Curves=wires, Preserve=False)
item_2 = ListItem(List=join_2, Index=Slider(0, range=0..1), Wrap=True)
pcen = PolygonCenter(Polyline=item_2)  # -> CenterV, CenterE, CenterA
scale = Scale(Geometry=item_2, Center=pcen.CenterV, Factor=Slider(1.02, range=0..10))  # -> Geometry, Transform

# ---- group: 3D surface eval
brep = Brep(surface)
number_slider = Slider(-0.1, range=-10..1)
offsets_4 = OffsetOnSrf(Curve=offsets_3, Distance=number_slider, Surface=brep)
srfsplit = SurfaceSplit(Surface=brep, Curves=offsets_4)
item_3 = ListItem(List=srfsplit, Index="-1", Wrap=True)

# ----
multiplication_2 = Multiplication(A=number_slider, B=Slider(5, range=0..10))
offsets_5 = OffsetOnSrf(Curve=offsets_3, Distance=multiplication_2, Surface=brep)
srfsplit_2 = SurfaceSplit(Surface=brep, Curves=offsets_5)
rad = Radians(Degrees=D)
center = Center(Geometric=brep)  # -> Center, Dimension
brep_cp = BrepClosestPoint(Point=center.Center, Brep=brep)  # -> Point, Normal, Distance
pl = PlaneNormal(Origin=brep_cp.Point, ZAxis=brep_cp.Normal)
X = UnitX(Factor=1)
deplane = DeconstructPlane(Plane=pl)  # -> Origin, XAxis, YAxis, ZAxis
rotate = Rotate(Geometry=deplane.XAxis, Angle=rad, Plane=pl)  # -> Geometry, Transform
Y = UnitY(Factor=1)
contour = Contour(Shape=item_3, Point=Point(0, 0, 0), Direction=rotate.Geometry, Distance=relay_2)  # -> flatten(Contours)
dispatch = Dispatch(List=flatten(contour), DispatchPattern=[True, False])  # -> ListA, ListB
flip = FlipCurve(Curve=dispatch.ListB)  # -> Curve, Flag
weave = Weave(Pattern=[0, 1], Stream0=dispatch.ListA, Stream1=flip.Curve, NullGaps=False)
disc = Discontinuity(Curve=weave, Level=1)  # -> flatten(Points), Parameters
points = PointList(Points=disc.Points, Size=Slider(0.36, range=0..1))
cull_i = CullIndex(List=disc.Points, Indices=Slider(0, range=0..100), Wrap=True)
partition = PartitionList(List=cull_i, Size=Slider(2, range=0..10))  # -> simplify(Chunks)
pline = PolyLine(Vertices=flatten(disc.Points), Closed=False)
pull = PullCurve(Curve=pline, Surface=srfsplit_2)
pline_2 = PolyLine(Vertices=partition, Closed=False)  # -> flatten(Polyline)
panel = Panel(partition)
len = Length(Curve=pline_2)
smaller = SmallerThan(FirstNumber=len, SecondNumber=Slider(10, range=0..10))  # -> SmallerThan, OrEqualTo
larger = LargerThan(FirstNumber=len, SecondNumber=0)  # -> LargerThan, OrEqualTo
subtraction_2 = Subtraction(A=layer_numbers, B=Slider(1, range=0..1))
cull = CullPattern(List=pline_2, CullPattern=smaller.OrEqualTo)
join_3 = JoinCurves(Curves=[weave, cull], Preserve=False)
series_2 = Series(Start=layer_height, Step=layer_height, Count=subtraction_2)
offset = OffsetSurface(Surface=surface, Distance=series_2, Retrim=True)
merge = Merge(Data1=join_3, Data2=offsets, Data3=offsets_2)
pull_2 = PullCurve(Curve=merge, Surface=offset)
merge_2 = Merge(Data1=flatten(merge), Data2=flatten(pull_2))
preview_2 = CustomPreview(Geometry=merge_2, Material=ColourSwatch(SwatchColor=RGB(0, 0, 255)))
R = ClusterOutput(merge_2)
