# Grasshopper definition Open5x_Gcode_0503.gh (Grasshopper 1.0.7)

path = FilePath()
way_point_optimisation_0_5_scale = WayPointOptimisation05Scale(F=path)  # -> point_subset_2, vector_subset_2
crv = Curve(graft(<curve referenced from the Rhino model>))
brep = Brep(<brep referenced from the Rhino model>)
path_ijk = FilePath(graft(["C:\Users\Freddie Hong\Dropbox\Freddie Hong Studio\Open5x\Recevied\Manchester\Toolpath_test\Test_model_bunny\bunny_toolpath\0.txt", "C:\Users\Freddie Hong\Dropbox\Freddie Hong Studio\Open5x\Recevied\Manchester\Toolpath_test\Test_model_bunny\bunny_toolpath\1.txt", "C:\Users\Freddie Hong\Dropbox\Freddie Hong Studio\Open5x\Recevied\Manchester\Toolpath_test\Test_model_bunny\bunny_toolpath\2.txt", "C:\Users\Freddie Hong\Dropbox\Freddie Hong Studio\Open5x\Recevied\Manchester\Toolpath_test\Test_model_bunny\bunny_toolpath\3.txt"]))
file = ReadFile(File=path_ijk, PerLineParse=True)  # -> simplify(Content)
tool_path = ToolPath_2(curve=crv, base_surface=brep)  # -> point, vector

split = TextSplit(Text=file, Separators=" ")
c_script = CSharpScript(x=split)  # -> out, Xx, Yy, Zz, Ii, Jj, Kk; inputs x: list of String; same code as c_script
scaled_xyz = ScaledXYZ(D=c_script.Xx, D_2=c_script.Yy, D_3=c_script.Zz)  # -> R, R_3, R_2
pshift = ShiftPaths(Data=c_script.Ii, Offset=-1)
pshift_2 = ShiftPaths(Data=c_script.Jj, Offset=-1)
pshift_3 = ShiftPaths(Data=c_script.Kk, Offset=-1)
vec = VectorXYZ(XComponent=pshift, YComponent=pshift_2, ZComponent=pshift_3)  # -> Vector, Length

tool_path_2 = ToolPath(point=tool_path.point, vec=tool_path.vector, travel_height=Slider(20, range=0..100))  # -> segment_length, new_xyz, new_ijk, path_chaning_points, travel_path_length, entering_vector, exiting_vector
panel = Panel(tool_path_2.path_chaning_points)
inverse_kinematics = InverseKinematics(pt=tool_path_2.new_xyz, i_j_k=tool_path_2.new_ijk)  # -> R, acxyz

# ---- group: Extrusion
layer_height = Slider(0.25, range=0..1)
path_width = Slider(0.6, range=0..1)
filament_diameter = Slider(1.75, range=0..10)
c_extrusion = CSharpScript(w=path_width, h=layer_height, d=filament_diameter, x=Slider(1.4, range=0..10), Length=tool_path_2.segment_length)  # -> out, A; inputs w: Double, h: Double, d: Double, x: Double, Length: Double
# ---------- c_extrusion: C# ----------
    // For calculating the Extrusion amount for given length of segment

    // w = path width
    // h = layer height
    // d = filament diametre
    // x = extrusion multiplier


    double area = ((w - h) * h) + (Math.PI * (Math.Pow(h / 2, 2)));


      A = (area * Length * 4) / (Math.PI * Math.Pow(d, 2) * (1 / x));
# ---------- c_extrusion: C# additional code ----------
  /// <summary>
  /// This method will be called once every solution, before any calls to RunScript.
  /// </summary>
  public override void BeforeRunScript()
  { }
  /// <summary>
  /// This method will be called once every solution, after any calls to RunScript.
  /// </summary>
  public override void AfterRunScript()
  { }
# ---------- end c_extrusion ----------
panel_2 = Panel(c_extrusion.A)

# ---- group: Speed
print_speed_mm_s = Slider(1, range=0..100)
number_slider = Slider(60, range=0..100)
multiplication = Multiplication(A=print_speed_mm_s, B=number_slider)
multiplication_2 = Multiplication(A=Slider(10, range=0..100), B=number_slider)
speed_compensation = SpeedCompensation(
    acxyz=inverse_kinematics.acxyz,
    extrusion_length=panel_2,
    segment_length=tool_path_2.segment_length,
    feedrate=multiplication,
    travel_speed=multiplication_2,
    travel_path_length=tool_path_2.travel_path_length,
    patch_chaingin_index=tool_path_2.path_chaning_points)

# ----
number_slider_2 = Slider(0, range=0..1000)

lng = ListLength(List=flatten(tool_path_2.new_xyz))
multiplication_3 = Multiplication(A=lng, B=Slider(0.656, range=0.001..1))
int = Integer(multiplication_3)
addition = Addition(A=int, B=Slider(1, range=0..1))
simulation_item = ListItem(List=inverse_kinematics.R, Index=int, Wrap=True)
split_2 = SplitList(List=flatten(tool_path_2.new_xyz), Index=addition)  # -> ListA, ListB
preview_full_path = BooleanToggle(False)
item = ListItem(List=flatten(tool_path_2.new_ijk), Index=addition, Wrap=True)
panel_3 = Panel(simulation_item)
pline = PolyLine(Vertices=split_2.ListA, Closed=False)
simulation = Simulation(
    D=simulation_item,
    printed_path=pline,
    i=int,
    ijk=item,
    brep=brep,
    view_full_path=preview_full_path,
    entering_vector=tool_path_2.entering_vector,
    exiting_vector=tool_path_2.exiting_vector)  # -> point, new_vector
vdis = VectorDisplay(Anchor=simulation.point, Vector=simulation.new_vector)

panel_5 = Panel(tool_path_2.path_chaning_points)

c_script_2 = CSharpScript(x=graft(panel))  # -> out, A; inputs x: list of Double
# ---------- c_script_2: C# ----------
    x.Insert(0, x[0] - 1); // add retracting index
    x.Insert(x.Count, x[1] + 1); // add deretracing index   
    // now x[1] is traveling
    
    A = x;
# ---------- end c_script_2 ----------
panel_6 = Panel(c_script_2.A)
item_2 = ListItem(List=c_script_2.A, Index=Slider(0, range=0..100), Wrap=True)  # -> flatten(Item)
item_3 = ListItem(List=c_script_2.A, Index="-1", Wrap=True)  # -> flatten(Item)
panel_7 = Panel(item_2)
concat = Concatenate(FragmentA="G1 F", FragmentC=Slider(2100, range=0..10000), FragmentB=" E2.21 ;Filament (De)-Retraction!!")
concat_2 = Concatenate(FragmentA="G1 F", FragmentC=Slider(2300, range=0..10000), FragmentB=" E-2.00 ;Filament Retraction!!")
panel_8 = Panel(concat)
panel_9 = Panel(concat_2)

lng_2 = ListLength(List=panel_7)
series = Series(Start=Slider(2, range=0..10), Step=1, Count=lng_2)
panel_10 = Panel(series)

addition_2 = Addition(A=item_3, B=panel_10)

# ----
# Machine OFFSET
# 
# X 144.6
# Y 90.5
bang = ExplodeTree(Data=inverse_kinematics.acxyz)  # -> Branch0, Branch1, Branch2, Branch3, Branch4
addition_3 = Addition(A=bang.Branch3, B=Slider(57.4, range=0..100))
addition_4 = Addition(A=bang.Branch2, B=Slider(144.9, range=0..1000))
concat_3 = Concatenate(
    FragmentN="G1 ",
    FragmentM="F",
    FragmentO=speed_compensation,
    FragmentA=" x",
    FragmentF=addition_4,
    FragmentB=" y",
    FragmentG=addition_3,
    FragmentC=" z",
    FragmentH=bang.Branch4,
    FragmentD=" u",
    FragmentI=bang.Branch0,
    FragmentE=" v",
    FragmentJ=bang.Branch1,
    FragmentK=" E",
    FragmentL=panel_2)  # -> simplify(flatten(Result))
panel_11 = Panel("""; START 5_axis G-code
; We assume that machine is not stopped from planar construction


G90 ; use absolute coordinates

Z60.750

T0 ; Pick up Tool 1
G0 Z80;

M302 P1 ; Allow cold extrusion



M104 S225 ; set extruder temp
M109 S225 ; wait for extruder temp
G21 ; set units to millimeters

G90 ; use absolute coordinates
M83 ; use relative distances for extrusion

M98 P"/macros/wiping.g" ;move the nozzle to centre

G0 u0 v0 ;
M98 P"/macros/move_to_mid.g" ;move the nozzle to centre


G1 E1.0 ; initial extrusion""")
ins_retraction = InsertItems(List=concat_3, Item=panel_9, Indices=item_2, Wrap=True)  # -> flatten(List)
ins_deretraction = InsertItems(List=ins_retraction, Item=panel_8, Indices=addition_2, Wrap=True)  # -> flatten(List)
panel_12 = Panel("""; END G-CODE
G1 E-1
M104 S0 ; turn off temperature
G0 Z100 ; move the head up

T-1 ; Drop the head""")
merge = Merge(Data1=flatten(panel_11), Data2=ins_deretraction, Data3=flatten(panel_12))
panel_13 = Panel(merge)

# ==== cluster Simulation
D = ClusterInput()
bang = ExplodeTree(Data=D)  # -> Branch0, Branch1, Branch2, Branch3, Branch4
A = Panel(bang.Branch0)
Y = Panel(bang.Branch3)
X = Panel(bang.Branch2)
Z = Panel(bang.Branch4)
C = Panel(bang.Branch1)
path = FilePath("C:\Users\Freddie Hong\Dropbox\Freddie Hong Studio\Open5x\Grasshopper\2023-03-10-E3D-OPEN5X-B-profile.3dm")
path_2 = FilePath("C:\Users\Freddie Hong\Dropbox\Freddie Hong Studio\Open5x\3D Model\archiv\211018_E3D_Fred_5axis_profile.3dm")
exiting_vector = ClusterInput()
entering_vector = ClusterInput()
printed_path = ClusterInput()
ijk = ClusterInput()

# ----
# Y Axis Orientation
panel = Panel("Y")
_3dm = Import3DM(File=path_2, Layer=panel, Name="*")
preview = CustomPreview(Geometry=_3dm, Material=ColourSwatch(SwatchColor=RGBA(255, 255, 188, 71)))

transform = Transform(Geometry=printed_path, Transform=bang.Branch1)
transform_2 = Transform(Geometry=ijk, Transform=bang.Branch1)
transform_3 = Transform(Geometry=transform, Transform=bang.Branch0)
transform_4 = Transform(Geometry=transform_2, Transform=bang.Branch0)

# ----
# Nozzle (XYZ) Orientation
_3dm_2 = Import3DM(File=path, Layer="nozzle", Name="*")
vec = VectorXYZ(XComponent=bang.Branch2, YComponent=bang.Branch3, ZComponent=bang.Branch4)  # -> Vector, Length
move = Move(Geometry=_3dm_2, Motion=vec.Vector)  # -> Geometry, Transform
preview_2 = CustomPreview(Geometry=move.Geometry, Material=ColourSwatch(SwatchColor=RGBA(131, 172, 200, 157)))

i = ClusterInput()
cp = ControlPoints(Curve=transform_3)  # -> Points, Weights, Knots
item = ListItem(List=cp.Points, Index=i, Wrap=True)
view_full_path = ClusterInput()

# ---- group: Curve Inversed Path
# Stock Orientation
crv = ClusterInput()
brep = ClusterInput()
crv_2 = Curve(flatten(crv))
brep_2 = Brep(graft(brep))
group = Group(Objects=[crv_2, brep_2])
transform_5 = Transform(Geometry=group, Transform=bang.Branch1)
panel_2 = Panel(group)
transform_6 = Transform(Geometry=transform_5, Transform=bang.Branch0)  # -> flatten(Geometry)
dispatch = Dispatch(List=transform_6, DispatchPattern=[True, False])  # -> ListA, ListB
gate = StreamGate(Stream=dispatch.ListA, Gate=view_full_path)  # -> Target0, Target1
swatch = ColourSwatch(SwatchColor=RGB(255, 243, 210))
preview_3 = CustomPreview(Geometry=gate.Target0, Material=swatch)
preview_4 = CustomPreview(Geometry=dispatch.ListB, Material=swatch)

# ----
preview_5 = CustomPreview(Geometry=transform_3, Material=ColourSwatch(SwatchColor=RGB(0, 0, 255)))
point = ClusterOutput(item)
new_vector = ClusterOutput(transform_4)

# ----
# C Axis Orientation
panel_3 = Panel("C")
_3dm_3 = Import3DM(File=path, Layer=panel_3, Name="*")
transform_c = Transform(Geometry=_3dm_3, Transform=bang.Branch1)

transform_7 = Transform(Geometry=transform_c, Transform=bang.Branch0)

preview_6 = CustomPreview(Geometry=transform_7, Material=ColourSwatch(SwatchColor=RGBA(155, 217, 200, 157)))

# ----
# A Axis Orientation
panel_4 = Panel("A")
_3dm_4 = Import3DM(File=path, Layer=panel_4, Name="*")

transform_a = Transform(Geometry=_3dm_4, Transform=bang.Branch0)

preview_7 = CustomPreview(Geometry=transform_a, Material=ColourSwatch(SwatchColor=RGBA(255, 157, 200, 157)))

# ---- group: Travel Path
transform_8 = Transform(Geometry=entering_vector, Transform=bang.Branch1)
transform_9 = Transform(Geometry=exiting_vector, Transform=bang.Branch1)
transform_10 = Transform(Geometry=transform_9, Transform=bang.Branch0)
transform_11 = Transform(Geometry=transform_8, Transform=bang.Branch0)
bang_2 = ExplodeTree(Data=transform_10)  # -> Branch0, Branch1
bang_3 = ExplodeTree(Data=transform_11)  # -> Branch0, Branch1
move_2 = Move(Geometry=bang_2.Branch0, Motion=bang_2.Branch1)  # -> Geometry, Transform

# ----
rev = Reverse(Vector=bang_3.Branch1)
move_3 = Move(Geometry=bang_3.Branch0, Motion=rev)  # -> Geometry, Transform
shift = ShiftList(List=move_2.Geometry, Shift=1, Wrap=True)
gate_2 = StreamGate(Stream=move_3.Geometry, Gate=view_full_path)  # -> Target0, Target1, Target2
gate_3 = StreamGate(Stream=bang_2.Branch0, Gate=view_full_path)  # -> Target0, Target1, Target2
ln = Line(StartPoint=move_3.Geometry, EndPoint=shift)
gate_4 = StreamGate(Stream=ln, Gate=view_full_path)  # -> Target0, Target1

# ---- group: Travel Path (continued)
preview_8 = CustomPreview(Geometry=gate_4.Target0, Material=ColourSwatch(SwatchColor=RGBA(255, 255, 255, 162)))
vdisex = VectorDisplayEx(
    Point=gate_3.Target0,
    Vector=bang_2.Branch1,
    Colour=ColourSwatch(SwatchColor=RGBA(55, 240, 202, 106)),
    Width=Slider(2, range=0..10))
vdisex_2 = VectorDisplayEx(
    Point=gate_2.Target0,
    Vector=bang_3.Branch1,
    Colour=ColourSwatch(SwatchColor=RGBA(255, 0, 62, 154)),
    Width=Slider(2, range=0..10))

# ==== cluster InverseKinematics
pt = ClusterInput()
i_j_k = ClusterInput()
pt_2 = Point(flatten(pt))
vec = Vector(flatten(i_j_k))
pdecon = Deconstruct(Point=pt_2)  # -> XComponent, YComponent, ZComponent
devec = DeconstructVector(Vector=vec)  # -> XComponent, YComponent, ZComponent
c_script = CSharpScript()  # -> out, OptA, OptC, flatten(FinalToggle); inputs angleA: list of Double, PangleC: list of Double, Dir: list of Double, dc: list of Double
# ---------- c_script: C# ----------
    List<double> oA = new List<double>();
    List<double> oC = new List<double>();
    List<bool> toggler = new List<bool>();

    bool toggle;
    toggle = false;


    for (int i = 0; i < Dir.Count; i++){

      if(Dir[i] == 1 && Math.Abs(dc[i]) > 175 ){ //if direction chagne is detected and the c-axis differnce is near 180
        toggle = !toggle;
      }

      if(toggle == true){
        oA.Add(angleA[i] * -1); // if the quadrant changes, change the direction of the A-axis rotation
        if(PangleC[i] < 0){ // if the original C angle is - negative
          oC.Add(PangleC[i] + Math.PI); //Stop the c-axis rotation
        }else if(PangleC[i] >= 0){
          oC.Add(PangleC[i] - Math.PI);
        }
      }
      else{// if no direction is detected
        oA.Add(Math.Round(angleA[i], 2)); // keep the A-axis as it is
        oC.Add(Math.Round(PangleC[i], 2)); // keep the C-axis as it is

      }

      toggler.Add(toggle);
    }

    OptA = oA;
    OptC = oC;
    FinalToggle = toggler;
# ---------- end c_script ----------
c_script_2 = CSharpScript(
    x=pdecon.XComponent,
    y=pdecon.YComponent,
    z=pdecon.ZComponent,
    i=devec.XComponent,
    j=devec.YComponent,
    k=devec.ZComponent)  # -> out, angleA, angleC; inputs x: list of Double, y: list of Double, z: list of Double, i: list of Double, j: list of Double, k: list of Double
# ---------- c_script_2: C# ----------
    // xyz is the input Point
    // ijk is the input unit normal vector

    List<double> A = new List<double>(); //A-axis angle list
    List<double> C = new List<double>(); //C-axis angle list


    /*Cacluate A-axis*/
    // A = arcos(k)
    for (int v = 0; v < k.Count; v++){
      A.Add(Math.Acos(k[v]));// * 180 / Math.PI);// convert radian to degree
    }

    /*Cacluate C-axis*/
    // C = Atan2 (j,i)
    for(int u = 0; u < i.Count; u++){

      C.Add(Math.Atan2(j[u], i[u]));// * 180 / Math.PI);

      C[u] = (C[u] * -1);// + (Math.PI / 2); //axis direction need to be inverted from clockwise to anticlockwise rotation then we need to add 90 degree to make it align with y axis

    }
    angleA = A;
    angleC = C;
# ---------- end c_script_2 ----------

# ---- group: Dir changing point
c_a_axis_polarity_optimisation = CSharpScript(x=devec.XComponent, y=devec.YComponent)  # -> out, vX, vY; inputs x: list of Double, y: list of Double
# ---------- c_a_axis_polarity_optimisation: C# ----------
    List<double> vecX = new List<double>(); //xPos
    List<double> vecY = new List<double>(); //yPos

    /* Add polrarity to X vector*/
    for (int i = 0; i < x.Count; i++){
      double a = Math.Round(x[i], 6);

      if(a >= 0){
        vecX.Add(1);
      }
      else if(a < 0){
        vecX.Add(-1);
      }
    }

    /* Add polrarity to Y vector*/
    for (int i = 0; i < y.Count; i++){
      double b = Math.Round(y[i], 6);

      if(b >= 0){
        vecY.Add(1);
      }
      else if(b < 0){
        vecY.Add(-1);
      }
    }

    vX = vecX;
    vY = vecY;
# ---------- end c_a_axis_polarity_optimisation ----------
c_direction_decider = CSharpScript(vX=c_a_axis_polarity_optimisation.vX, vY=c_a_axis_polarity_optimisation.vY)  # -> out, Dir, D; inputs vX: list of Double, vY: list of Double
# ---------- c_direction_decider: C# ----------
    List<bool> toggle = new List<bool>(); //xPos
    List<bool> tfList = new List<bool>(); //tf
    bool button = false; //
    bool tf = false;
    toggle.Add(button);
    tfList.Add(false);

    for (int i = 1; i < vX.Count; i++){

      if (vX[i] != vX[i - 1] || vY[i] != vY[i - 1]){
        button = !button;
        tf = true;
      }
      else{
        tf = false;
      }
      toggle.Add(button);
      tfList.Add(tf);
    }

    Dir = toggle;
    D = tfList;
# ---------- end c_direction_decider ----------

# ----
c_axis_absoulte_to_period = CAxisAbsoulteToPeriod(T=c_script_2.angleC)
reldif = RelativeDifferences(Values=c_axis_absoulte_to_period)
deg = Degrees(Radians=reldif)
c_script_3 = CSharpScript(dc=deg)  # -> out, direction; inputs dc: list of Double
# ---------- c_script_3: C# ----------
    List<int> dirList = new List<int>();
    int dir = -1;

    for (int i = 0; i < dc.Count; i++){
      if(dc[i] > 176){
        dir = -1;
      }
      else if(dc[i] <= -176){
        dir = +1;
      }
      dirList.Add(dir);
    }

    direction = dirList;
# ---------- end c_script_3 ----------
c_script_4 = CSharpScript(
    angleA=c_script_2.angleA,
    PangleC=c_axis_absoulte_to_period,
    Dir=c_direction_decider.D,
    dc=deg,
    direction=c_script_3.direction)  # -> out, OptA, OptC, flatten(FinalToggle); inputs angleA: list of Double, PangleC: list of Double, Dir: list of Double, dc: list of Double, direction: list of Int32
# ---------- c_script_4: C# ----------
    List<double> oA = new List<double>();
    List<double> oC = new List<double>();
    List<bool> toggler = new List<bool>();

    bool toggle;
    toggle = false;


    for (int i = 0; i < Dir.Count; i++){

      if(Dir[i] == 1 && Math.Abs(dc[i]) > 175 ){ //if direction chagne is detected and the c-axis differnce is near 180
        toggle = !toggle;
      }

      if(toggle == true){
        oA.Add(angleA[i] * -1); // if the quadrant changes, change the direction of the A-axis rotation
        if(direction[i] == 1){ // if the original C angle is - negative
          oC.Add(PangleC[i] + Math.PI); //Stop the c-axis rotation
        }else if(direction[i] == -1){
          oC.Add(PangleC[i] - Math.PI);
        }
      }
      else{// if no direction is detected
        oA.Add(Math.Round(angleA[i], 2)); // keep the A-axis as it is
        oC.Add(Math.Round(PangleC[i], 2)); // keep the C-axis as it is

      }

      toggler.Add(toggle);
    }

    OptA = oA;
    OptC = oC;
    FinalToggle = toggler;
# ---------- end c_script_4 ----------

# ---- group: Og Vector Check
pt_3 = Point(pt_2)

# ----
deg_2 = Degrees(Radians=c_axis_absoulte_to_period)
deg_3 = Degrees(Radians=c_script_4.OptC)  # -> flatten(Degrees)
nozzle_orientation_changing = Panel(c_direction_decider.D)
nozzle_orientation_toggle = Panel(c_direction_decider.Dir)
direction = Panel(c_script_3.direction)
relative_c_axis = Panel(deg)
pre_optmised_c_axis = Panel(deg_2)
optmised_c_axis = Panel(deg_3)
final_toggle = Panel(c_script_4.FinalToggle)
c_axis_absoulte_to_period_2 = CAxisAbsoulteToPeriod(T=c_script_4.OptC)
deg_4 = Degrees(Radians=c_axis_absoulte_to_period_2)
reldif_2 = RelativeDifferences(Values=deg_4)
c_axis_rotation = Panel(deg_4)
xz = XZPlane(Origin=Point(0, 0, 0))

# ---- group: Rotate Point
xy = XYPlane(Origin=Point(0, 0, 0))
rotate_c = Rotate(Geometry=pt_3, Angle=c_axis_absoulte_to_period_2, Plane=xy)  # -> Geometry, Transform
yz = YZPlane(Origin=Point(0, 0, 0))
rotate_a = Rotate(Geometry=rotate_c.Geometry, Angle=c_script_4.OptA, Plane=xz)  # -> Geometry, Transform

# ---- group: Rotate Vector
xy_2 = XYPlane(Origin=Point(0, 0, 0))
rotate_c_2 = Rotate(Geometry=vec, Angle=c_axis_absoulte_to_period_2, Plane=xy_2)  # -> Geometry, Transform
rotate_a_2 = Rotate(Geometry=rotate_c_2.Geometry, Angle=c_script_4.OptA, Plane=xz)  # -> Geometry, Transform
vdisex = VectorDisplayEx(Point=pt_3, Vector=rotate_a_2.Geometry, Colour=RGB(0, 0, 0), Width=2)

# ----
optmised_differences = Panel(reldif_2)
panel = Panel(rotate_a.Geometry)
pdecon_2 = Deconstruct(Point=rotate_a.Geometry)  # -> XComponent, YComponent, ZComponent
deg_5 = Degrees(Radians=c_script_4.OptA)
deg_6 = Degrees(Radians=c_axis_absoulte_to_period_2)
gcode_entwine_position_and_orientation = Entwine(
    Branch00=deg_5,
    Branch01=deg_6,
    Branch02=pdecon_2.XComponent,
    Branch03=pdecon_2.YComponent,
    Branch04=pdecon_2.ZComponent,
    FlattenInputs=True)
simulation_entwine_matrix = Entwine(
    Branch00=rotate_a.Transform,
    Branch01=rotate_c_2.Transform,
    Branch02=pdecon_2.XComponent,
    Branch03=pdecon_2.YComponent,
    Branch04=pdecon_2.ZComponent,
    FlattenInputs=True)

number_slider = Slider(100, range=0..100)
multiplication = Multiplication(A=gcode_entwine_position_and_orientation, B=number_slider)
int = Integer(multiplication)
division = Division(A=int, B=number_slider)
acxyz = ClusterOutput(division)

R = ClusterOutput(simulation_entwine_matrix)

# ==== cluster SpeedCompensation
acxyz = ClusterInput()  # ACXYZ
reldif = RelativeDifferences(Values=acxyz)
feedrate = ClusterInput()
segment_length = ClusterInput()
extrusion_length = ClusterInput()
patch_chaingin_index = ClusterInput()
travel_path_length = ClusterInput()
travel_speed = ClusterInput()
bang = ExplodeTree(Data=reldif)  # -> Branch0, Branch1, Branch2, Branch3, Branch4
num = Number(extrusion_length)
num_2 = Number(segment_length)

# ---- group: Travel Path Length
num_3 = Number(flatten(travel_path_length))
travel_path_length_2 = Panel(num_3)

# ----
num_4 = Number(patch_chaingin_index)
panel = Panel(num)
path_changing_index = Panel(num_4)
# Microstep
# X16 Y16 Z16 E32 A16 C16
# 
# Steps/mm
# X100 Y100 Z400 E280
# 
# Steps/deg
# A26.667 C17.778
panel_2 = Panel(bang.Branch4)
c_script = CSharpScript(a=bang.Branch0, c=bang.Branch1, x=bang.Branch2, y=bang.Branch3, z=bang.Branch4, e=num)  # -> out, D; inputs a: Double, c: Double, x: Double, y: Double, z: Double, e: Double
# ---------- c_script: C# ----------
    double As; //square of a axis differences
    double Cs;
    double Xs;
    double Ys;
    double Zs;
    double Es;

    As = Math.Pow(a, 2);
    Cs = Math.Pow(c, 2);
    Xs = Math.Pow(x, 2);
    Ys = Math.Pow(y, 2);
    Zs = Math.Pow(z, 2);
    Es = Math.Pow(e, 2);
    
    D = Math.Sqrt(As + Cs + Xs + Ys + Zs +Es);
# ---------- end c_script ----------
euclidian_distance_mm = Panel(c_script.D)
retraction_speed_index = CSharpScript(x=panel)  # -> out, Index; inputs x: list of Double
# ---------- retraction_speed_index: C# ----------
    List<double> index = new List<double>();
    // List<double> rotation = new List<double>();

    for(int i = 0; i < x.Count; i++){

      if(x[i] == 0 || x[i] == 1 ){ // FIND ENTERING AND EXITTING

        index.Add(i);
      }

    }

    Index = index;
# ---------- end retraction_speed_index ----------
item = ListItem(List=c_script.D, Index=path_changing_index, Wrap=True)
division = Division(A=c_script.D, B=num_2)
travel_path_euclidiean = Panel(item)
panel_3 = Panel(retraction_speed_index.Index)
speed_compensation_ratio = Panel(division)
division_2 = Division(A=item, B=path_changing_index)
multiplication = Multiplication(A=division, B=feedrate)
new_sped_mm_min = Panel(multiplication)
division_3 = Division(A=euclidian_distance_mm, B=new_sped_mm_min)
panel_4 = Panel(division_3)
panel_5 = Panel(division_2)
maximum_feedrate_over_ride = CSharpScript(x=multiplication)  # -> out, A; inputs x: list of Double
# ---------- maximum_feedrate_over_ride: C# ----------
    //M203 X12000.00 Y12000.00 Z750.00 E1500.00 A5000.00 C5000.00

    for (int i = 0; i < x.Count; i++){

      if(x[i] > 9000){
        x[i] = 9000;
      }

      A = x;
    }
# ---------- end maximum_feedrate_over_ride ----------
multiplication_2 = Multiplication(A=travel_speed, B=division_2)
# M203 X12000.00 Y12000.00 Z750.00 E1500.00 A5000.00 C12000.00  	    ; Set maximum speeds (mm/min)
ma = MassAddition(Input=panel_4)  # -> Result, PartialResults
panel_6 = Panel(ma.Result)
replace = ReplaceItems(List=maximum_feedrate_over_ride.A, Item=multiplication_2, Indices=path_changing_index, Wrap=False)
replace_2 = ReplaceItems(List=replace, Item=travel_speed, Indices=panel_3, Wrap=False)
c_script_2 = CSharpScript(D=c_script.D, F=replace_2, a=bang.Branch0, c=bang.Branch1, x=bang.Branch2, y=bang.Branch3, z=bang.Branch4, e=num)  # -> out, Af, Cf, Xf, Yf, Zf, Ef; inputs D: Double, F: Double, a: Double, c: Double, x: Double, y: Double, z: Double, e: Double
# ---------- c_script_2: C# ----------
    double Time; // time for each line of G-code (Min)

    Time = D / F;


    Af = Math.Abs(a / Time);
    Cf = Math.Abs(c / Time);
    Xf = Math.Abs(x / Time);
    Yf = Math.Abs(y / Time);
    Zf = Math.Abs(z / Time);
    Ef = Math.Abs(e / Time);
# ---------- end c_script_2 ----------
panel_7 = Panel(c_script_2.Yf)
feed_mm_min = Panel(c_script_2.Ef)
panel_8 = Panel(c_script_2.Af)
panel_9 = Panel(replace_2)
division_4 = Division(A=panel_8, B=Slider(60, range=0..100))
panel_11 = Panel(division_4)

min_max_index = CSharpScript(
    x=c_script_2.Cf,
    Reference=["C:\Program Files (x86)\Microsoft.NET\Primary Interop Assemblies\adodb.dll", "C:\Program Files (x86)\Microsoft.NET\Primary Interop Assemblies\Microsoft.mshtml.dll", "C:\Program Files (x86)\Microsoft.NET\Primary Interop Assemblies\Microsoft.stdformat.dll", "C:\Program Files (x86)\Microsoft.NET\Primary Interop Assemblies\msdatasrc.dll", "C:\Program Files (x86)\Microsoft.NET\Primary Interop Assemblies\stdole.dll"])  # -> out, A, i, B; inputs x: list of Double
# ---------- min_max_index: C# usings ----------
using System.Linq;
# ---------- min_max_index: C# ----------
    for (int j = 0; j < x.Count; j++){
      for (int k = 0; k < x.Count; k++){

        bool res = Double.IsNaN(x[j]);
        if (res){
          x.Remove(x[j]);
        }

        else if (x[k] == 0){
          x.Remove(x[k]);
        }
      }
    }

    double maxValue = x.Max();
    double minValue = x.Min();
    double minIndex = x.ToList().IndexOf(minValue);


    A = maxValue;
    i = minIndex;
    B = minValue;
# ---------- end min_max_index ----------
index_of_min_value = Panel(min_max_index.i)
min_value = Panel(min_max_index.B)
max_value = Panel(min_max_index.A)

# ----
# Speed of Each Axis
min_max_index_2 = CSharpScript(
    x=c_script_2.Af,
    Reference=["C:\Program Files (x86)\Microsoft.NET\Primary Interop Assemblies\adodb.dll", "C:\Program Files (x86)\Microsoft.NET\Primary Interop Assemblies\Microsoft.mshtml.dll", "C:\Program Files (x86)\Microsoft.NET\Primary Interop Assemblies\Microsoft.stdformat.dll", "C:\Program Files (x86)\Microsoft.NET\Primary Interop Assemblies\msdatasrc.dll", "C:\Program Files (x86)\Microsoft.NET\Primary Interop Assemblies\stdole.dll"])  # -> out, A, i, B; inputs x: list of Double; same code as min_max_index
max_value_2 = Panel(min_max_index_2.A)
index_of_min_value_2 = Panel(min_max_index_2.i)
min_value_2 = Panel(min_max_index_2.B)

min_max_index_3 = CSharpScript(
    x=c_script_2.Xf,
    Reference=["C:\Program Files (x86)\Microsoft.NET\Primary Interop Assemblies\adodb.dll", "C:\Program Files (x86)\Microsoft.NET\Primary Interop Assemblies\Microsoft.mshtml.dll", "C:\Program Files (x86)\Microsoft.NET\Primary Interop Assemblies\Microsoft.stdformat.dll", "C:\Program Files (x86)\Microsoft.NET\Primary Interop Assemblies\msdatasrc.dll", "C:\Program Files (x86)\Microsoft.NET\Primary Interop Assemblies\stdole.dll"])  # -> out, A, i, B; inputs x: list of Double; same code as min_max_index
index_of_min_value_3 = Panel(min_max_index_3.i)
max_value_3 = Panel(min_max_index_3.A)
min_value_3 = Panel(min_max_index_3.B)

min_max_index_4 = CSharpScript(
    x=c_script_2.Yf,
    Reference=["C:\Program Files (x86)\Microsoft.NET\Primary Interop Assemblies\adodb.dll", "C:\Program Files (x86)\Microsoft.NET\Primary Interop Assemblies\Microsoft.mshtml.dll", "C:\Program Files (x86)\Microsoft.NET\Primary Interop Assemblies\Microsoft.stdformat.dll", "C:\Program Files (x86)\Microsoft.NET\Primary Interop Assemblies\msdatasrc.dll", "C:\Program Files (x86)\Microsoft.NET\Primary Interop Assemblies\stdole.dll"])  # -> out, A, i, B; inputs x: list of Double; same code as min_max_index
index_of_min_value_4 = Panel(min_max_index_4.i)
max_value_4 = Panel(min_max_index_4.A)
min_value_4 = Panel(min_max_index_4.B)

min_max_index_5 = CSharpScript(
    x=c_script_2.Zf,
    Reference=["C:\Program Files (x86)\Microsoft.NET\Primary Interop Assemblies\adodb.dll", "C:\Program Files (x86)\Microsoft.NET\Primary Interop Assemblies\Microsoft.mshtml.dll", "C:\Program Files (x86)\Microsoft.NET\Primary Interop Assemblies\Microsoft.stdformat.dll", "C:\Program Files (x86)\Microsoft.NET\Primary Interop Assemblies\msdatasrc.dll", "C:\Program Files (x86)\Microsoft.NET\Primary Interop Assemblies\stdole.dll"])  # -> out, A, i, B; inputs x: list of Double; same code as min_max_index
max_value_5 = Panel(min_max_index_5.A)
index_of_min_value_5 = Panel(min_max_index_5.i)
min_value_5 = Panel(min_max_index_5.B)

feedrate_2 = ClusterOutput(replace_2)

# ==== cluster ToolPath
vec = ClusterInput()
point = ClusterInput()
vec_2 = Vector(vec)
travel_height = ClusterInput()

# ---- group: Entering Path / Starting Point
item = ListItem(List=point, Index=0, Wrap=True)

# ---- group: Starting Vector
item_2 = ListItem(List=vec_2, Index=0, Wrap=True)

# ---- group: Entering Path
amp = Amplitude(Vector=item_2, Amplitude=travel_height)
approaching_point = Move(Geometry=item, Motion=amp)  # -> Geometry, Transform
vec2pt = Vector2Pt(PointA=approaching_point.Geometry, PointB=item, Unitize=False)  # -> Vector, Length
approaching_vector = VectorDisplay(Anchor=approaching_point.Geometry, Vector=vec2pt.Vector)

# ----
panel = Panel(item_2)
panel_2 = Panel(vec2pt.Vector)
panel_3 = Panel(approaching_point.Geometry)
entwine = Entwine(Branch00=item, Branch01=vec2pt.Vector, FlattenInputs=True)
panel_5 = Panel(entwine)
entering_vector = ClusterOutput(entwine)

# ---- group: Add Entering Point
ins = InsertItems(List=point, Item=approaching_point.Geometry, Indices=Slider(0, range=0..100), Wrap=True)

# ---- group: Add Entering Vec
ins_2 = InsertItems(List=vec_2, Item=item_2, Indices=Slider(0, range=0..100), Wrap=True)

# ----
panel_6 = Panel(ins_2)
lng = ListLength(List=point)
addition = Addition(A=lng, B=Slider(1, range=0..1))
panel_7 = Panel(addition)

num = Number(flatten(addition))
addition_2 = Addition(A=num, B=Slider(1, range=0..1))
ma = MassAddition(Input=addition_2)  # -> Result, PartialResults
lng_2 = ListLength(List=ma.PartialResults)
subtraction = Subtraction(A=lng_2, B=Slider(1, range=0..1))
cull_i = CullIndex(List=ma.PartialResults, Indices=subtraction, Wrap=True)
path_chaning_points = ClusterOutput(cull_i)

number_slider = Slider(0, range=0..100)
panel_8 = Panel(ma.PartialResults)
panel_9 = Panel(cull_i)

# ---- group: Exiting_Path
number_slider_2 = Slider(-1, range=-1..1)

# ---- group: Ending Vector
item_3 = ListItem(List=vec_2, Index=number_slider_2, Wrap=True)

# ---- group: Exiting_Path / Ending Point
item_4 = ListItem(List=point, Index=number_slider_2, Wrap=True)

# ---- group: Exiting_Path (continued)
amp_2 = Amplitude(Vector=item_3, Amplitude=travel_height)
exiting_point = Move(Geometry=item_4, Motion=amp_2)  # -> Geometry, Transform
vec2pt_2 = Vector2Pt(PointA=item_4, PointB=exiting_point.Geometry, Unitize=False)  # -> Vector, Length
approaching_vector_2 = VectorDisplay(Anchor=item_4, Vector=vec2pt_2.Vector)

# ----
entwine_2 = Entwine(Branch00=item_4, Branch01=vec2pt_2.Vector, FlattenInputs=True)
exiting_vector = ClusterOutput(entwine_2)

# ---- group: Add Exiting_Point
ins_3 = InsertItems(List=ins, Item=exiting_point.Geometry, Indices=Slider(-1, range=-1..1), Wrap=True)

# ---- group: Add Exiting_Vec
ins_4 = InsertItems(List=ins_2, Item=item_3, Indices=Slider(-1, range=-1..1), Wrap=True)

# ----
panel_10 = Panel(ins_4)
new_xyz = ClusterOutput(ins_3)
new_ijk = ClusterOutput(ins_4)
ln = Line(StartPoint=approaching_point.Geometry, EndPoint=exiting_point.Geometry)
len = Length(Curve=ln)
travel_path_legth = Panel(len)
travel_path_length = ClusterOutput(len)

# ---- group: Segment Length
pline = PolyLine(Vertices=ins_3, Closed=False)
explode = Explode(Curve=pline, Recursive=True)  # -> Segments, Vertices
len_2 = Length(Curve=explode.Segments)  # -> simplify(Length)

# ----
replace = ReplaceItems(List=len_2, Item=number_slider, Indices=number_slider, Wrap=False)
replace_2 = ReplaceItems(List=replace, Item=number_slider, Indices="-1", Wrap=True)
panel_11 = Panel(len_2)
nullrep = ReplaceNulls(Items=replace_2, Replacements=Slider(0, range=0..100))  # -> Items, Count

# ---- group: Segment Length (continued)
ins_5 = InsertItems(List=nullrep.Items, Item="0", Indices="0", Wrap=True)  # -> flatten(List)

# ----
segment_length = ClusterOutput(ins_5)
panel_12 = Panel(ins_5)

# ==== cluster ScaledXYZ
D = ClusterInput()
D_2 = ClusterInput()
D_3 = ClusterInput()
pshift = ShiftPaths(Data=D, Offset=-1)
pshift_2 = ShiftPaths(Data=D_2, Offset=-1)
pshift_3 = ShiftPaths(Data=D_3, Offset=-1)
division = Division(A=pshift, B="2")
division_2 = Division(A=pshift_2, B="2")
division_3 = Division(A=pshift_3, B="2")
R = ClusterOutput(division)
R_2 = ClusterOutput(division_3)
R_3 = ClusterOutput(division_2)

# ==== cluster WayPointOptimisation05Scale
F = ClusterInput()
file = ReadFile(File=F, PerLineParse=True)
split = TextSplit(Text=file, Separators=" ")
c_script = CSharpScript(x=split)  # -> out, Xx, Yy, Zz, Ii, Jj, Kk; inputs x: list of String
# ---------- c_script: C# ----------
    List<string> pointCloud = new List<string>(); //A-axis angle list
    List<string> X = new List<string>(); //A-axis angle list
    List<string> Y = new List<string>(); //C-axis angle list
    List<string> Z = new List<string>(); //C-axis angle list

    List<string> I = new List<string>(); //C-axis angle list
    List<string> J = new List<string>(); //C-axis angle list
    List<string> K = new List<string>(); //C-axis angle list

    for (int i = 0; i < x.Count; i++){


      string[] xyzijk = x[i].Split(' ');

      pointCloud.Add(xyzijk[0]);


    }
    X.Add(pointCloud[0]);
    Y.Add(pointCloud[1]);
    Z.Add(pointCloud[2]);
    I.Add(pointCloud[3]);
    J.Add(pointCloud[4]);
    K.Add(pointCloud[5]);




    Xx = X; //pointCloud;
    Yy = Y;
    Zz = Z; //pointCloud;
    Ii = I;
    Jj = J; //pointCloud;
    Kk = K;
# ---------- end c_script ----------
vector = Vector(D=c_script.Ii, D_2=c_script.Jj, D_3=c_script.Kk)  # -> D_4, D_5, D_6
scaled_xyz = ScaledXYZ(D=c_script.Xx, D_2=c_script.Yy, D_3=c_script.Zz)  # -> R, R_3, R_2
pt = ConstructPoint(XCoordinate=scaled_xyz.R, YCoordinate=scaled_xyz.R_3, ZCoordinate=scaled_xyz.R_2)
vec = VectorXYZ(XComponent=vector.D_4, YComponent=vector.D_5, ZComponent=vector.D_6)  # -> Vector, Length
shift = ShiftList(List=pt, Shift=1, Wrap=True)
dist = Distance(PointA=pt, PointB=shift)
cull_i = CullIndex(List=dist, Indices="-1", Wrap=True)
c_split_long_travel = CSharpScript(x=cull_i)  # -> out, ni; inputs x: list of Double
# ---------- c_split_long_travel: C# ----------
    List<double> index = new List<double>(); //index of the new angle
    index.Add(0);

    for (int i = 0; i < x.Count; i++){

      if( x[i] > 2 ){
        index.Add(i);// add the index of the movement larger than 270 abs
      }
    }
    //   if (index.Count == 1){

    index.Add(x.Count -1 );
    //  }
    ni = index;
# ---------- end c_split_long_travel ----------
panel = Panel(cull_i)
panel_2 = Panel(c_split_long_travel.ni)

# ---- group: Construct New Domain
consec = ConsecutiveDomains(Numbers=c_split_long_travel.ni, Additive=Toggle(False))
panel_3 = Panel(consec)
dedomain = DeconstructDomain(Domain=consec)  # -> Start, End
addition = Addition(A=dedomain.Start, B=Slider(1, range=0..1))
number_slider = Slider(0, range=0..100)
panel_4 = Panel(addition)
replace = ReplaceItems(List=addition, Item=number_slider, Indices=number_slider, Wrap=False)
dom = ConstructDomain(DomainStart=replace, DomainEnd=dedomain.End)
panel_5 = Panel(replace)

# ----
panel_6 = Panel(dom)
vector_subset = SubList(List=vec.Vector, Domain=dom, Wrap=True)  # -> List, Index
point_subset = SubList(List=pt, Domain=dom, Wrap=True)  # -> List, Index
panel_7 = Panel(vector_subset.List)
panel_8 = Panel(point_subset.List)
vector_subset_2 = ClusterOutput(vector_subset.List)
point_subset_2 = ClusterOutput(point_subset.List)

# ==== cluster ToolPath_2
base_surface = ClusterInput()  # Base Surface
number_slider = Slider(1, range=0..10)
curve = ClusterInput()  # Curve
len = Length(Curve=curve)
panel = Panel(curve)
division = Division(A=len, B=Slider(0.6, range=0..5))

# ---- group: Curve Into Plane
disc = Discontinuity(Curve=curve, Level=1)  # -> Points, Parameters
divide = DivideCurve(Curve=curve, Count=division, Kinks=False)  # -> Points, Tangents, Parameters
merge = Merge(Data1=disc.Points, Data2=divide.Points)
duppt = RemoveDuplicatePts(Points=merge, Tolerance=0.01)
simplify = SimplifyTree(Tree=duppt, Front=False)
alongcrv = SortAlongCurve(Points=simplify, Curve=curve)  # -> Points, Indices
pl = ConstructPlane(Origin=alongcrv.Points, XAxis=Vector(1, 0, 0), YAxis=Vector(0, 1, 0))  # -> simplify(Plane)

# ----
brep_cp = BrepClosestPoint(Point=pl, Brep=base_surface)  # -> Point, Normal, Distance
vector = ClusterOutput(brep_cp.Normal)
point = ClusterOutput(pl)

# ==== cluster CAxisAbsoulteToPeriod
T = ClusterInput()
flatten = FlattenTree(Tree=T, Path="{0}")

# ---- group: For Compainrg
c_to_calculate_relative = CSharpScript(x=flatten)  # -> out, rD; inputs x: list of Double
# ---------- c_to_calculate_relative: C# ----------
    List<double> d = new List<double>(); //A-axis angle list



    // find releative values
    for (int i = 1; i < x.Count; i++){
      d.Add(x[i] - x[i - 1]);
    }
    d.Insert(0, x[0]); // add the first value in the list to correct the offset
    rD = d;
# ---------- end c_to_calculate_relative ----------
c_sin_arcsin = CSharpScript(rD=c_to_calculate_relative.rD)  # -> out, nA, index; inputs rD: list of Double
# ---------- c_sin_arcsin: C# ----------
    List<double> A = new List<double>(); //new angle after sig-arsin
    List<double> nindex = new List<double>(); //index of the new angle

    for (int i = 0; i < rD.Count; i++){

      if( rD[i] > 3 * Math.PI / 2 || rD[i] < -3 * Math.PI / 2){ //if value is larger than 270 and smaller than -270
        nindex.Add(i);// add the index of the movement larger than 270 abs
        A.Add(Math.Asin(Math.Sin(rD[i])));// add new rotation value
      }

      else if( rD[i] < -Math.PI && rD[i] > -3 * Math.PI / 2 ){ // if the value is between -270 and - 180
        nindex.Add(i);
        A.Add(-Math.Asin(Math.Sin(rD[i])) + Math.PI);
      }
      else if( rD[i] > Math.PI && rD[i] < 3 * Math.PI / 2){
        nindex.Add(i);
        A.Add(-Math.Asin(Math.Sin(rD[i])) - Math.PI);
      }


      nA = A;
      index = nindex;
    }
# ---------- end c_sin_arcsin ----------
replace = ReplaceItems(List=c_to_calculate_relative.rD, Item=c_sin_arcsin.nA, Indices=c_sin_arcsin.index, Wrap=False)

# ----
number_slider = Slider(3, range=0..10)
deg = Degrees(Radians=flatten)
ma = MassAddition(Input=replace)  # -> Result, PartialResults
panel = Panel(deg)
deg_2 = Degrees(Radians=ma.PartialResults)
roundd = RoundToDecimalPlace(NumberX=deg, DecimalPlace=number_slider, RoundType=0)  # -> simplify(Rounded), Difference
roundd_2 = RoundToDecimalPlace(NumberX=deg_2, DecimalPlace=number_slider, RoundType=0)  # -> Rounded, Difference
roundd_3 = RoundToDecimalPlace(NumberX=ma.PartialResults, DecimalPlace=Slider(3, range=0..10), RoundType=0)  # -> Rounded, Difference
subtraction = Subtraction(A=roundd.Rounded, B=roundd_2.Rounded)
panel_2 = Panel(roundd_3.Rounded)
panel_3 = Panel(subtraction)
division = Division(A=subtraction, B=Slider(360, range=0..1000))
periodic_angle = ClusterOutput(roundd_3.Rounded)
panel_4 = Panel(division)

# ==== cluster Vector
D = ClusterInput()
D_2 = ClusterInput()
D_3 = ClusterInput()
pshift = ShiftPaths(Data=D, Offset=-1)
pshift_2 = ShiftPaths(Data=D_2, Offset=-1)
pshift_3 = ShiftPaths(Data=D_3, Offset=-1)
D_4 = ClusterOutput(pshift)
D_5 = ClusterOutput(pshift_2)
D_6 = ClusterOutput(pshift_3)
