# Grasshopper definition open5x_supportless_slicing_ver2.gh (Grasshopper 1.0.7)
# plug-ins: Heteroptera

# This is Demo version.
# Stable full version is on the way.
# Make sure the substrate is centred to (0,0)
substrate = Brep(<brep referenced from the Rhino model>)
supportless_brep = Brep(simplify(graft([<brep referenced from the Rhino model> x3])))

# ----
# Toggle to TRUE To Slice and Generate Gcode
# 
# This may take several minutes
toggle = BooleanToggle(False)

infill_direction = Slider(45, range=0..1000)
number_of_perimeters = Slider(2, range=0..10)
path_width = Slider(0.42, range=0..1)
# Resolving issues with layerheight not working for small number.
# Resolved version will be uploaded very soon
layerheight = Slider(2, range=0..3)

print_speed_mm_s = Slider(3, range=0..100)
filament_diameter = Slider(1.75, range=0..10)
extrusion_multiplier = Slider(1.2, range=0..10)
path_width_2 = Slider(0.6, range=0..1)

# ----
# Controllers
# Path setup
# Extrusion setup
# Retraction setup
# Simulation
simulation = Slider(0.569, range=0.001..1)

# ----
# Open5x
# Supportless Toolpathing
# 2022/03/17
center = Center(Geometric=substrate)  # -> Center, Dimension
cluster_conformal_pathing = ClusterConformalPathing(
    guide_point=center.Center,
    brep=supportless_brep,
    layer_height=layerheight,
    path_width=path_width,
    infill_direction=infill_direction,
    number_of_perimeter=number_of_perimeters)  # -> T, pr, path_without_infill

path_curve = Curve(graft(cluster_conformal_pathing.path_without_infill))
gate = StreamGate(Stream=path_curve, Gate=toggle)  # -> Target0, Target1

# ---- group: Preview
layer_no = Slider(17, range=0..50)
obj_no = Slider(0, range=0..10)
select_obj_and_layer_height = GhPythonScript(x=obj_no, y=layer_no)  # -> out, a; inputs x: Int32, y: Int32
# ---------- select_obj_and_layer_height: Python ----------
__author__ = "Freddie_Hong"
__version__ = "2022.02.04"

import rhinoscriptsyntax as rs


a= ("{"+ str(x)+";" +  "*"+  ";"+ str(y)+"}")
# ---------- end select_obj_and_layer_height ----------
panel = Panel(select_obj_and_layer_height.a)
swatch = ColourSwatch(SwatchColor=RGB(0, 0, 255))
split = SplitTree(Data=cluster_conformal_pathing.path_without_infill, Masks=flatten(panel))  # -> Positive, Negative

# ----
# Simulation
# Open5x: Slicing
# 
# 2022/03/03
# G-CODE
# Speed Setting
# Extrusion setup
# Filament Retraction setup
# (advanced setting)
path_curve_2 = Curve(gate.Target1)
tool_path_evalauation = ToolPathEvalauation(curve=path_curve_2, guide_srf=substrate, travel_height=Slider(0.2, range=0..1), travelheight=Slider(20, range=0..100))  # -> plane, L, entering_vector, exiting_vector, path_chaning_points, travel_path_length
inverse_kinematics = InverseKinematics(pln=tool_path_evalauation.plane)  # -> R, acxyz

c_script = CSharpScript(x=graft(tool_path_evalauation.path_chaning_points))  # -> out, A; inputs x: list of Double
# ---------- c_script: C# ----------
    x.Insert(0, x[0] - 1); // add retracting index
    x.Insert(x.Count, x[1] + 1); // add deretracing index   
    // now x[1] is traveling
    
    A = x;
# ---------- end c_script ----------
panel_2 = Panel(c_script.A)
item = ListItem(List=c_script.A, Index=Slider(0, range=0..100), Wrap=True)  # -> flatten(Item)
panel_3 = Panel(item)
item_2 = ListItem(List=c_script.A, Index="-1", Wrap=True)  # -> flatten(Item)
concat = Concatenate(FragmentA="G1 F", FragmentC=Slider(300, range=0..10000), FragmentB=" E-1.00 ;Filament Retraction!!")
concat_2 = Concatenate(FragmentA="G1 F", FragmentC=Slider(300, range=0..10000), FragmentB=" E1.1;Filament (De)-Retraction!!")
lng = ListLength(List=panel_3)
series = Series(Start=Slider(2, range=0..10), Step=1, Count=lng)
panel_4 = Panel(concat_2)
panel_5 = Panel(concat)
panel_6 = Panel(series)
addition = Addition(A=item_2, B=panel_6)

preview = CustomPreview(Geometry=split.Positive, Material=swatch)

c_extrusion = CSharpScript(w=path_width_2, h=layerheight, d=filament_diameter, x=extrusion_multiplier, Length=tool_path_evalauation.L)  # -> out, A; inputs w: Double, h: Double, d: Double, x: Double, Length: Double
# ---------- c_extrusion: C# ----------
    // For calculating the Extrusion amount for given length of segment

    // w = path width
    // h = layer height
    // d = filament diametre
    // x = extrusion multiplier


    double area = ((w - h) * h) + (Math.PI * (Math.Pow(h / 2, 2)));


      A = (area * Length * 4) / (Math.PI * Math.Pow(d, 2) * (1 / x));
# ---------- c_extrusion: C# additional code ----------
  /// <summary>
  /// This method will be called once every solution, before any calls to RunScript.
  /// </summary>
  public override void BeforeRunScript()
  { }
  /// <summary>
  /// This method will be called once every solution, after any calls to RunScript.
  /// </summary>
  public override void AfterRunScript()
  { }
# ---------- end c_extrusion ----------
panel_7 = Panel(c_extrusion.A)

lng_2 = ListLength(List=tool_path_evalauation.plane)
multiplication = Multiplication(A=lng_2, B=simulation)
int = Integer(multiplication)
simulation_item = ListItem(List=inverse_kinematics.R, Index=int, Wrap=True)
simulation_2 = Simulation(
    D=simulation_item,
    crv=path_curve_2,
    brep=substrate,
    entering_vector=tool_path_evalauation.entering_vector,
    exiting_vector=tool_path_evalauation.exiting_vector)
panel_8 = Panel(simulation_item)

number_slider = Slider(60, range=0..100)
multiplication_2 = Multiplication(A=print_speed_mm_s, B=number_slider)
multiplication_3 = Multiplication(A=Slider(10, range=0..100), B=number_slider)
speed_compensation = SpeedCompensation(
    acxyz=inverse_kinematics.acxyz,
    extrusion_length=panel_7,
    segment_length=tool_path_evalauation.L,
    feedrate=multiplication_2,
    travel_speed=multiplication_3,
    travel_path_length=tool_path_evalauation.travel_path_length,
    patch_chaingin_index=tool_path_evalauation.path_chaning_points)

bang = ExplodeTree(Data=inverse_kinematics.acxyz)  # -> Branch0, Branch1, Branch2, Branch3, Branch4
concat_3 = Concatenate(
    FragmentN="G1 ",
    FragmentM="F",
    FragmentO=speed_compensation,
    FragmentA=" x",
    FragmentF=bang.Branch2,
    FragmentB=" y",
    FragmentG=bang.Branch3,
    FragmentC=" z",
    FragmentH=bang.Branch4,
    FragmentD=" u",
    FragmentI=bang.Branch0,
    FragmentE=" v",
    FragmentJ=bang.Branch1,
    FragmentK=" E",
    FragmentL=panel_7)  # -> simplify(flatten(Result))
panel_9 = Panel("""; START Prusa 5_axis G-code
; We assume that machine is not stopped from planar construction


G90 ; use absolute coordinates

G0 Z80;

M104 S220 ; set extruder temp
M109 S220 ; wait for extruder temp
G21 ; set units to millimeters

G1 u0.1 v0.1; Give a little kick to A and B motor
G1 u0 v0 ;

G90 ; use absolute coordinates
M83 ; use relative distances for extrusion

M98 P"/macros/move_to_mid.g" ;move the nozzle to centre

G1 E0.1 ; initial extrusion""")
panel_10 = Panel("""; END G-CODE
G1 E-1
M104 S0 ; turn off temperature
G0 Z80 ; move the head up""")
ins_retraction = InsertItems(List=concat_3, Item=panel_5, Indices=item, Wrap=True)  # -> flatten(List)
ins_deretraction = InsertItems(List=ins_retraction, Item=panel_4, Indices=addition, Wrap=True)  # -> flatten(List)
merge = Merge(Data1=flatten(panel_9), Data2=ins_deretraction, Data3=flatten(panel_10))
# To save the G-code
# 1) Right click the yellow notepad
# 2) Select stream destination
# 3) Click stream few times to ensure the latest value is saved :)
panel_11 = Panel(merge)

# ----
# To save the G-code
# 1) Right click the yellow notepad
# 2) Select stream destination
# 3) Click stream few times to ensure the latest value is saved :)
panel_12 = Panel(merge)

# ==== cluster InverseKinematics
pln = ClusterInput()
pln_2 = Plane(pln)
deplane = DeconstructPlane(Plane=pln_2)  # -> Origin, XAxis, YAxis, ZAxis
panel = Panel(deplane.ZAxis)
points = PointList(Points=deplane.Origin, Size=Slider(1, range=0..10))
position = Panel(deplane.Origin)
xz = XZPlane(Origin=Point(0, 0, 0))
number_slider = Slider(100, range=0..100)

# ----
# C axis angle
devec = DeconstructVector(Vector=deplane.ZAxis)  # -> XComponent, YComponent, ZComponent
num = Number(devec.XComponent)
num_2 = Number(devec.YComponent)
expression = Expression(x=num, y=num_2, Expression="Atan2(y,x)")
neg = Negative(Value=expression)
deg = Degrees(Radians=neg)

cluster = Cluster(radian=neg)  # -> pr, L
panel_2 = Panel(deg)
panel_3 = Panel(cluster.pr)
subtraction = Subtraction(A=panel_2, B=panel_3)
round = Round(Number=subtraction)  # -> Nearest, Floor, Ceiling
panel_4 = Panel(round.Nearest)

# ----
# A axis angle
devec_2 = DeconstructVector(Vector=deplane.ZAxis)  # -> XComponent, YComponent, ZComponent
xy = XYPlane(Origin=Point(0, 0, 0))

c_script = CSharpScript(x=devec_2.ZComponent)  # -> out, A; inputs x: list of Double
# ---------- c_script: C# ----------
    for(int i = 0; i < x.Count; i++){
      if(x[i] == -1){
        x[i] = 1;
      }
    }
    
      A = x;
# ---------- end c_script ----------

acos = ArcCosine(Value=c_script.A)
multiplication = Multiplication(A=acos)
deg_2 = Degrees(Radians=multiplication)
rotate = Rotate(Geometry=xy, Angle=acos, Plane=xz)  # -> Geometry, Transform

panel_5 = Panel(c_script.A)

rad = Radians(Degrees=cluster.pr)
rotate_2 = Rotate(Geometry=rotate.Geometry, Angle=rad, Plane=rotate.Geometry)  # -> Geometry, Transform

# ----
# X Y Z coordinates
transform = Transform(Geometry=pln_2, Transform=rotate.Transform)
transform_2 = Transform(Geometry=transform, Transform=rotate_2.Transform)
plcoord = PlaneCoordinates(Point=transform_2, System=PlaneXY(0, 0, 0))  # -> XCoordinate, YCoordinate, ZCoordinate

panel_6 = Panel(deg_2)
neg_2 = Negative(Value=plcoord.YCoordinate)
gcode_entwine_position_and_orientation = Entwine(
    Branch00=deg_2,
    Branch01=cluster.pr,
    Branch02=plcoord.XCoordinate,
    Branch03=plcoord.YCoordinate,
    Branch04=plcoord.ZCoordinate,
    FlattenInputs=True)
simulation_entwine_matrix = Entwine(
    Branch00=rotate.Transform,
    Branch01=rotate_2.Transform,
    Branch02=plcoord.XCoordinate,
    Branch03=plcoord.YCoordinate,
    Branch04=plcoord.ZCoordinate,
    FlattenInputs=True)
R = ClusterOutput(simulation_entwine_matrix)
multiplication_2 = Multiplication(A=gcode_entwine_position_and_orientation, B=number_slider)
int = Integer(multiplication_2)
division = Division(A=int, B=number_slider)
acxyz = ClusterOutput(division)

# ==== cluster SpeedCompensation
acxyz = ClusterInput()  # ACXYZ
reldif = RelativeDifferences(Values=acxyz)
feedrate = ClusterInput()
segment_length = ClusterInput()
extrusion_length = ClusterInput()
patch_chaingin_index = ClusterInput()
travel_path_length = ClusterInput()
travel_speed = ClusterInput()
bang = ExplodeTree(Data=reldif)  # -> Branch0, Branch1, Branch2, Branch3, Branch4
num = Number(extrusion_length)
num_2 = Number(segment_length)

# ---- group: Travel Path Length
num_3 = Number(flatten(travel_path_length))
travel_path_length_2 = Panel(num_3)

# ----
num_4 = Number(patch_chaingin_index)
panel = Panel(num)
path_changing_index = Panel(num_4)
# Microstep
# X16 Y16 Z16 E32 A16 C16
# 
# Steps/mm
# X100 Y100 Z400 E280
# 
# Steps/deg
# A26.667 C17.778
panel_2 = Panel(bang.Branch4)
c_script = CSharpScript(a=bang.Branch0, c=bang.Branch1, x=bang.Branch2, y=bang.Branch3, z=bang.Branch4, e=num)  # -> out, D; inputs a: Double, c: Double, x: Double, y: Double, z: Double, e: Double
# ---------- c_script: C# ----------
    double As; //square of a axis differences
    double Cs;
    double Xs;
    double Ys;
    double Zs;
    double Es;

    As = Math.Pow(a, 2);
    Cs = Math.Pow(c, 2);
    Xs = Math.Pow(x, 2);
    Ys = Math.Pow(y, 2);
    Zs = Math.Pow(z, 2);
    Es = Math.Pow(e, 2);
    
    D = Math.Sqrt(As + Cs + Xs + Ys + Zs +Es);
# ---------- end c_script ----------
euclidian_distance_mm = Panel(c_script.D)
retraction_speed_index = CSharpScript(x=panel)  # -> out, Index; inputs x: list of Double
# ---------- retraction_speed_index: C# ----------
    List<double> index = new List<double>();
    // List<double> rotation = new List<double>();

    for(int i = 0; i < x.Count; i++){

      if(x[i] == 0 || x[i] == 1 ){ // FIND ENTERING AND EXITTING

        index.Add(i);
      }

    }

    Index = index;
# ---------- end retraction_speed_index ----------
item = ListItem(List=c_script.D, Index=path_changing_index, Wrap=True)
division = Division(A=c_script.D, B=num_2)
travel_path_euclidiean = Panel(item)
panel_3 = Panel(retraction_speed_index.Index)
speed_compensation_ratio = Panel(division)
division_2 = Division(A=item, B=path_changing_index)
multiplication = Multiplication(A=division, B=feedrate)
new_sped_mm_min = Panel(multiplication)
division_3 = Division(A=euclidian_distance_mm, B=new_sped_mm_min)
panel_4 = Panel(division_3)
panel_5 = Panel(division_2)
maximum_feedrate_over_ride = CSharpScript(x=multiplication)  # -> out, A; inputs x: list of Double
# ---------- maximum_feedrate_over_ride: C# ----------
    //M203 X12000.00 Y12000.00 Z750.00 E1500.00 A5000.00 C5000.00

    for (int i = 0; i < x.Count; i++){

      if(x[i] > 9000){
        x[i] = 9000;
      }

      A = x;
    }
# ---------- end maximum_feedrate_over_ride ----------
multiplication_2 = Multiplication(A=travel_speed, B=division_2)
# M203 X12000.00 Y12000.00 Z750.00 E1500.00 A5000.00 C12000.00  	    ; Set maximum speeds (mm/min)
ma = MassAddition(Input=panel_4)  # -> Result, PartialResults
panel_6 = Panel(ma.Result)
replace = ReplaceItems(List=maximum_feedrate_over_ride.A, Item=multiplication_2, Indices=path_changing_index, Wrap=False)
replace_2 = ReplaceItems(List=replace, Item=travel_speed, Indices=panel_3, Wrap=False)
c_script_2 = CSharpScript(D=c_script.D, F=replace_2, a=bang.Branch0, c=bang.Branch1, x=bang.Branch2, y=bang.Branch3, z=bang.Branch4, e=num)  # -> out, Af, Cf, Xf, Yf, Zf, Ef; inputs D: Double, F: Double, a: Double, c: Double, x: Double, y: Double, z: Double, e: Double
# ---------- c_script_2: C# ----------
    double Time; // time for each line of G-code (Min)

    Time = D / F;


    Af = Math.Abs(a / Time);
    Cf = Math.Abs(c / Time);
    Xf = Math.Abs(x / Time);
    Yf = Math.Abs(y / Time);
    Zf = Math.Abs(z / Time);
    Ef = Math.Abs(e / Time);
# ---------- end c_script_2 ----------
panel_7 = Panel(c_script_2.Yf)
feed_mm_min = Panel(c_script_2.Ef)
panel_8 = Panel(c_script_2.Af)
panel_9 = Panel(replace_2)
division_4 = Division(A=panel_8, B=Slider(60, range=0..100))
panel_11 = Panel(division_4)

min_max_index = CSharpScript(
    x=c_script_2.Cf,
    Reference=["C:\Program Files (x86)\Microsoft.NET\Primary Interop Assemblies\adodb.dll", "C:\Program Files (x86)\Microsoft.NET\Primary Interop Assemblies\Microsoft.mshtml.dll", "C:\Program Files (x86)\Microsoft.NET\Primary Interop Assemblies\Microsoft.stdformat.dll", "C:\Program Files (x86)\Microsoft.NET\Primary Interop Assemblies\msdatasrc.dll", "C:\Program Files (x86)\Microsoft.NET\Primary Interop Assemblies\stdole.dll"])  # -> out, A, i, B; inputs x: list of Double
# ---------- min_max_index: C# usings ----------
using System.Linq;
# ---------- min_max_index: C# ----------
    for (int j = 0; j < x.Count; j++){
      for (int k = 0; k < x.Count; k++){

        bool res = Double.IsNaN(x[j]);
        if (res){
          x.Remove(x[j]);
        }

        else if (x[k] == 0){
          x.Remove(x[k]);
        }
      }
    }

    double maxValue = x.Max();
    double minValue = x.Min();
    double minIndex = x.ToList().IndexOf(minValue);


    A = maxValue;
    i = minIndex;
    B = minValue;
# ---------- end min_max_index ----------
index_of_min_value = Panel(min_max_index.i)
min_value = Panel(min_max_index.B)
max_value = Panel(min_max_index.A)

# ----
# Speed of Each Axis
min_max_index_2 = CSharpScript(
    x=c_script_2.Af,
    Reference=["C:\Program Files (x86)\Microsoft.NET\Primary Interop Assemblies\adodb.dll", "C:\Program Files (x86)\Microsoft.NET\Primary Interop Assemblies\Microsoft.mshtml.dll", "C:\Program Files (x86)\Microsoft.NET\Primary Interop Assemblies\Microsoft.stdformat.dll", "C:\Program Files (x86)\Microsoft.NET\Primary Interop Assemblies\msdatasrc.dll", "C:\Program Files (x86)\Microsoft.NET\Primary Interop Assemblies\stdole.dll"])  # -> out, A, i, B; inputs x: list of Double; same code as min_max_index
max_value_2 = Panel(min_max_index_2.A)
index_of_min_value_2 = Panel(min_max_index_2.i)
min_value_2 = Panel(min_max_index_2.B)

min_max_index_3 = CSharpScript(
    x=c_script_2.Xf,
    Reference=["C:\Program Files (x86)\Microsoft.NET\Primary Interop Assemblies\adodb.dll", "C:\Program Files (x86)\Microsoft.NET\Primary Interop Assemblies\Microsoft.mshtml.dll", "C:\Program Files (x86)\Microsoft.NET\Primary Interop Assemblies\Microsoft.stdformat.dll", "C:\Program Files (x86)\Microsoft.NET\Primary Interop Assemblies\msdatasrc.dll", "C:\Program Files (x86)\Microsoft.NET\Primary Interop Assemblies\stdole.dll"])  # -> out, A, i, B; inputs x: list of Double; same code as min_max_index
index_of_min_value_3 = Panel(min_max_index_3.i)
max_value_3 = Panel(min_max_index_3.A)
min_value_3 = Panel(min_max_index_3.B)

min_max_index_4 = CSharpScript(
    x=c_script_2.Yf,
    Reference=["C:\Program Files (x86)\Microsoft.NET\Primary Interop Assemblies\adodb.dll", "C:\Program Files (x86)\Microsoft.NET\Primary Interop Assemblies\Microsoft.mshtml.dll", "C:\Program Files (x86)\Microsoft.NET\Primary Interop Assemblies\Microsoft.stdformat.dll", "C:\Program Files (x86)\Microsoft.NET\Primary Interop Assemblies\msdatasrc.dll", "C:\Program Files (x86)\Microsoft.NET\Primary Interop Assemblies\stdole.dll"])  # -> out, A, i, B; inputs x: list of Double; same code as min_max_index
index_of_min_value_4 = Panel(min_max_index_4.i)
max_value_4 = Panel(min_max_index_4.A)
min_value_4 = Panel(min_max_index_4.B)

min_max_index_5 = CSharpScript(
    x=c_script_2.Zf,
    Reference=["C:\Program Files (x86)\Microsoft.NET\Primary Interop Assemblies\adodb.dll", "C:\Program Files (x86)\Microsoft.NET\Primary Interop Assemblies\Microsoft.mshtml.dll", "C:\Program Files (x86)\Microsoft.NET\Primary Interop Assemblies\Microsoft.stdformat.dll", "C:\Program Files (x86)\Microsoft.NET\Primary Interop Assemblies\msdatasrc.dll", "C:\Program Files (x86)\Microsoft.NET\Primary Interop Assemblies\stdole.dll"])  # -> out, A, i, B; inputs x: list of Double; same code as min_max_index
max_value_5 = Panel(min_max_index_5.A)
index_of_min_value_5 = Panel(min_max_index_5.i)
min_value_5 = Panel(min_max_index_5.B)

feedrate_2 = ClusterOutput(replace_2)

# ==== cluster ToolPathEvalauation
cluster_replace_vector_length = ClusterReplaceVectorLength()
travelheight = ClusterInput()
number_slider = Slider(20, range=0..100)
guide_srf = ClusterInput()
travel_height = ClusterInput()
curve = ClusterInput()  # Curve
brep = Brep(guide_srf)
len = Length(Curve=curve)
division = Division(A=len, B=Slider(0.2, range=0..5))

# ---- group: Curve Into Plane
disc = Discontinuity(Curve=curve, Level=1)  # -> Points, Parameters
divide = DivideCurve(Curve=curve, Count=division, Kinks=False)  # -> Points, Tangents, Parameters
merge = Merge(Data1=disc.Points, Data2=divide.Points)
duppt = RemoveDuplicatePts(Points=merge, Tolerance=0.01)
simplify = SimplifyTree(Tree=duppt, Front=False)
alongcrv = SortAlongCurve(Points=simplify, Curve=curve)  # -> Points, Indices
pl = ConstructPlane(Origin=alongcrv.Points, XAxis=Vector(1, 0, 0), YAxis=Vector(0, 1, 0))  # -> simplify(Plane)

# ---- group: Entering Path / Starting Point
item = ListItem(List=pl, Index=0, Wrap=True)

# ----
panel = Panel(curve)
panel_2 = Panel(pl)
lng = ListLength(List=pl)
addition = Addition(A=lng, B=Slider(1, range=0..1))
number_slider_2 = Slider(0, range=0..100)

num = Number(flatten(addition))
addition_2 = Addition(A=num, B=Slider(1, range=0..1))
ma = MassAddition(Input=addition_2)  # -> Result, PartialResults
lng_2 = ListLength(List=ma.PartialResults)
subtraction = Subtraction(A=lng_2, B=Slider(1, range=0..1))
cull_i = CullIndex(List=ma.PartialResults, Indices=subtraction, Wrap=True)
path_chaning_points = ClusterOutput(cull_i)

panel_3 = Panel(addition)
panel_4 = Panel(ma.PartialResults)

number_slider_3 = Slider(2, range=0..10)
number_slider_4 = Slider(0, range=0..100)

# ---- group: Entering Path
brep_cp = BrepClosestPoint(Point=item, Brep=brep)  # -> Point, Normal, Distance
amp = Amplitude(Vector=brep_cp.Normal, Amplitude=travel_height)

# ----
trim = TrimTree(Tree=amp, Depth=number_slider_3)
trim_2 = TrimTree(Tree=brep_cp.Normal, Depth=number_slider_3)
amp_2 = Amplitude(Vector=trim_2, Amplitude=travelheight)
panel_5 = Panel(trim)
item_2 = ListItem(List=amp_2, Index=number_slider_4, Wrap=True)
replace = ReplaceItems(List=trim, Item=item_2, Indices=number_slider_4, Wrap=False)
flatten = FlattenTree(Tree=replace, Path="{0}")
unflatten = UnflattenTree(Tree=flatten, Guide=amp)

panel_6 = Panel(unflatten)

# ---- group: Entering Path (continued)
approaching_point = Move(Geometry=item, Motion=unflatten)  # -> Geometry, Transform
vec2pt = Vector2Pt(PointA=approaching_point.Geometry, PointB=item, Unitize=False)  # -> Vector, Length
approaching_vector = VectorDisplay(Anchor=approaching_point.Geometry, Vector=vec2pt.Vector)

# ----
panel_7 = Panel(approaching_point.Geometry)
entering_pt = Point(flatten(approaching_point.Geometry))

# ---- group: Add Entering Path
ins = InsertItems(List=pl, Item=approaching_point.Geometry, Indices=Slider(0, range=0..100), Wrap=True)

# ----
entwine = Entwine(Branch00=item, Branch01=vec2pt.Vector, FlattenInputs=True)
entering_vector = ClusterOutput(entwine)

number_slider_5 = Slider(20, range=0..100)
number_slider_6 = Slider(2, range=0..10)

# ---- group: Exiting_Path
number_slider_7 = Slider(-1, range=-1..1)

# ---- group: Exiting_Path / Ending Point
item_3 = ListItem(List=pl, Index=number_slider_7, Wrap=True)

# ---- group: Exiting_Path (continued)
brep_cp_2 = BrepClosestPoint(Point=item_3, Brep=brep)  # -> Point, Normal, Distance
amp_3 = Amplitude(Vector=brep_cp_2.Normal, Amplitude=travel_height)

# ----
trim_3 = TrimTree(Tree=brep_cp_2.Normal, Depth=number_slider_6)
trim_4 = TrimTree(Tree=amp_3, Depth=number_slider_6)
amp_4 = Amplitude(Vector=trim_3, Amplitude=travelheight)
lng_3 = ListLength(List=trim_4)
subtraction_2 = Subtraction(A=lng_3, B=Slider(1, range=0..1))
item_4 = ListItem(List=amp_4, Index="-1", Wrap=True)
replace_2 = ReplaceItems(List=trim_4, Item=item_4, Indices=subtraction_2, Wrap=False)
panel_8 = Panel(item_4)
flatten_2 = FlattenTree(Tree=replace_2, Path="{0}")
unflatten_2 = UnflattenTree(Tree=flatten_2, Guide=amp_3)
panel_9 = Panel(unflatten_2)

# ---- group: Exiting_Path (continued)
exiting_point = Move(Geometry=item_3, Motion=unflatten_2)  # -> Geometry, Transform
vec2pt_2 = Vector2Pt(PointA=item_3, PointB=exiting_point.Geometry, Unitize=False)  # -> Vector, Length
approaching_vector_2 = VectorDisplay(Anchor=item_3, Vector=vec2pt_2.Vector)

# ----
exit_pt = Point(flatten(exiting_point.Geometry))

# ---- group: Add Exiting_Path
ins_2 = InsertItems(List=ins, Item=exiting_point.Geometry, Indices=Slider(-1, range=-1..1), Wrap=True)

# ----
brep_cp_3 = BrepClosestPoint(Point=ins_2, Brep=guide_srf)  # -> Point, Normal, Distance
shift = ShiftList(List=exit_pt, Shift="-1", Wrap=True)
padjust = AdjustPlane(Plane=ins_2, Normal=brep_cp_3.Normal)  # -> flatten(Plane)
ln = Line(StartPoint=entering_pt, EndPoint=shift)
panel_10 = Panel(ln)
cull_i_2 = CullIndex(List=ln, Indices=Slider(0, range=0..100), Wrap=True)
len_2 = Length(Curve=cull_i_2)  # -> graft(Length)
travel_path_legth = Panel(len_2)
travel_path_length = ClusterOutput(len_2)
entwine_2 = Entwine(Branch00=item_3, Branch01=vec2pt_2.Vector, FlattenInputs=True)
plane = ClusterOutput(padjust)
exiting_vector = ClusterOutput(entwine_2)

# ---- group: Segment Length
pline = PolyLine(Vertices=ins_2, Closed=False)
explode = Explode(Curve=pline, Recursive=True)  # -> Segments, Vertices

# ----
replace_3 = ReplaceItems(List=explode.Segments, Item=number_slider_2, Indices=number_slider_2, Wrap=False)
replace_4 = ReplaceItems(List=replace_3, Item=number_slider_2, Indices="-1", Wrap=True)
panel_11 = Panel(replace_4)

# ---- group: Segment Length (continued)
len_3 = Length(Curve=replace_4)  # -> simplify(Length)

# ----
nullrep = ReplaceNulls(Items=len_3, Replacements=Slider(0, range=0..100))  # -> Items, Count

# ---- group: Segment Length (continued)
ins_3 = InsertItems(List=nullrep.Items, Item="0", Indices="0", Wrap=True)  # -> flatten(List)

# ----
panel_12 = Panel(ins_3)
L = ClusterOutput(ins_3)

# ==== cluster Simulation
D = ClusterInput()
bang = ExplodeTree(Data=D)  # -> Branch0, Branch1, Branch2, Branch3, Branch4
A = Panel(bang.Branch0)
Y = Panel(bang.Branch3)
X = Panel(bang.Branch2)
C = Panel(bang.Branch1)
Z = Panel(bang.Branch4)
exiting_vector = ClusterInput()
entering_vector = ClusterInput()
prusai3_machine_profile_path = FilePath("C:\Users\Freddie Hong\OneDrive - Imperial College London\Imperial\Freddie Hong_PhD\Document\Submission\Grasshopper _Definition\Prusa\Prusa_5axis_profile_v2.3dm")
brep = ClusterInput()
crv = ClusterInput()
panel = Panel(prusai3_machine_profile_path)
neg = Negative(Value=bang.Branch3)
brep_2 = Brep(graft(brep))
crv_2 = Curve(flatten(crv))

# ----
# Y Axis Orientation
panel_2 = Panel("Y")
_3dm = Import3DM(File=prusai3_machine_profile_path, Layer=panel_2, Name="*")
preview = CustomPreview(Geometry=_3dm, Material=ColourSwatch(SwatchColor=RGBA(255, 255, 188, 71)))

Y_2 = UnitY(Factor=neg)

# ---- group: Curve Inversed Path
# Stock Orientation
group = Group(Objects=[crv_2, brep_2])
transform = Transform(Geometry=group, Transform=bang.Branch0)
transform_2 = Transform(Geometry=transform, Transform=bang.Branch1)  # -> flatten(Geometry)

# ----
# Nozzle (XY) Orientation
X_2 = UnitX(Factor=bang.Branch2)
_3dm_2 = Import3DM(File=prusai3_machine_profile_path, Layer="nozzle", Name="*")
move = Move(Geometry=_3dm_2, Motion=X_2)  # -> Geometry, Transform
move_2 = Move(Geometry=move.Geometry, Motion=Y_2)  # -> Geometry, Transform

comp = Compound(Transforms=flatten([bang.Branch0, bang.Branch1]))

# ----
# C Axis Orientation
panel_3 = Panel("C-30")
_3dm_3 = Import3DM(File=prusai3_machine_profile_path, Layer=panel_3, Name="*")
transform_c = Transform(Geometry=_3dm_3, Transform=comp)
preview_2 = CustomPreview(Geometry=transform_c, Material=ColourSwatch(SwatchColor=RGBA(155, 217, 200, 157)))

panel_4 = Panel(group)

# ----
# Nozzle (Z) Orientation
Z_2 = UnitZ(Factor=bang.Branch4)
move_3 = Move(Geometry=move_2.Geometry, Motion=Z_2)  # -> Geometry, Transform
preview_3 = CustomPreview(Geometry=move_3.Geometry, Material=ColourSwatch(SwatchColor=RGBA(131, 172, 200, 157)))

dispatch = Dispatch(List=transform_2, DispatchPattern=[True, False])  # -> ListA, ListB
preview_4 = CustomPreview(Geometry=dispatch.ListB, Material=ColourSwatch(SwatchColor=RGBA(255, 255, 255, 110)))
preview_5 = CustomPreview(Geometry=dispatch.ListA, Material=ColourSwatch(SwatchColor=RGB(0, 0, 255)))

# ----
# A Axis Orientation
panel_5 = Panel("A")
_3dm_4 = Import3DM(File=prusai3_machine_profile_path, Layer=panel_5, Name="*")

transform_a = Transform(Geometry=_3dm_4, Transform=bang.Branch0)

preview_6 = CustomPreview(Geometry=transform_a, Material=ColourSwatch(SwatchColor=RGBA(255, 157, 200, 51)))

# ---- group: Travel Path
transform_3 = Transform(Geometry=exiting_vector, Transform=bang.Branch0)
transform_4 = Transform(Geometry=entering_vector, Transform=bang.Branch0)
transform_5 = Transform(Geometry=transform_3, Transform=bang.Branch1)
transform_6 = Transform(Geometry=transform_4, Transform=bang.Branch1)
bang_2 = ExplodeTree(Data=transform_6)  # -> Branch0, Branch1
bang_3 = ExplodeTree(Data=transform_5)  # -> Branch0, Branch1
move_4 = Move(Geometry=bang_3.Branch0, Motion=bang_3.Branch1)  # -> Geometry, Transform
vdisex = VectorDisplayEx(
    Point=bang_3.Branch0,
    Vector=bang_3.Branch1,
    Colour=ColourSwatch(SwatchColor=RGBA(55, 240, 202, 91)),
    Width=Slider(5, range=0..10))

# ----
rev = Reverse(Vector=bang_2.Branch1)
move_5 = Move(Geometry=bang_2.Branch0, Motion=rev)  # -> Geometry, Transform
shift = ShiftList(List=move_4.Geometry, Shift="-1", Wrap=True)

# ---- group: Travel Path (continued)
ln = Line(StartPoint=move_5.Geometry, EndPoint=shift)
vdisex_2 = VectorDisplayEx(
    Point=move_5.Geometry,
    Vector=bang_2.Branch1,
    Colour=ColourSwatch(SwatchColor=RGBA(255, 0, 50, 91)),
    Width=Slider(5, range=0..10))
preview_7 = CustomPreview(Geometry=ln, Material=ColourSwatch(SwatchColor=RGBA(255, 255, 255, 204)))

# ==== cluster ClusterConformalPathing
guide_point = ClusterInput()
infill_direction = ClusterInput()
path_width = ClusterInput()
number_of_perimeter = ClusterInput()
brep = ClusterInput()
layer_height = ClusterInput()
cluster_finding_normal_from_guide_point = ClusterFindingNormalFromGuidePoint(A=guide_point, B=brep, layer_height=layer_height)  # -> curve, A_2
srf = Surface(simplify(cluster_finding_normal_from_guide_point.A_2))
panel = Panel(srf)
crv = Curve(simplify(cluster_finding_normal_from_guide_point.curve))
panel_2 = Panel(crv)
num = Number(path_width)
num_2 = Number(number_of_perimeter)
number_slider = Slider(3, range=0..10)  # disabled
toggle = BooleanToggle(True)  # disabled

division = Division(A=num, B="2")
subtraction = Subtraction(A=num_2, B="1")
# Making Perimeters
multiplication = Multiplication(A=num, B=num_2)
series = Series(Start=num, Step=num, Count=subtraction)
addition = Addition(A=multiplication, B=division)
offsets = OffsetOnSrf(Curve=crv, Distance=addition, Surface=srf)  # disabled

neg = Negative(Value=division)
neg_2 = Negative(Value=series)

offsets_2 = OffsetOnSrf(Curve=crv, Distance=neg, Surface=srf)  # -> simplify(Curve)
# Tree Re-organising
offsets_3 = OffsetOnSrf(Curve=offsets_2, Distance=neg_2, Surface=srf)  # -> simplify(Curve)

merge = Merge(Data1=offsets_3, Data2=offsets_2)
panel_3 = Panel(merge)

number_slider_2 = Slider(-0.15, range=-10..1)  # disabled
# 3D Surface Evaluation
brep_2 = Brep(srf)  # disabled
offsets_4 = OffsetOnSrf(Curve=offsets, Distance=number_slider_2, Surface=brep_2)  # disabled
srfsplit = SurfaceSplit(Surface=brep_2, Curves=offsets_4)  # disabled
panel_4 = Panel("-1")  # disabled
item = ListItem(List=srfsplit, Index=panel_4, Wrap=True)  # -> simplify(Item); disabled

path_without_infill = ClusterOutput(merge)

center = Center(Geometric=brep_2)  # -> Center, Dimension; disabled
# Finding Infill pattern Direction
rad = Radians(Degrees=infill_direction)  # disabled
brep_cp = BrepClosestPoint(Point=center.Center, Brep=brep_2)  # -> Point, Normal, Distance; disabled
pl = PlaneNormal(Origin=brep_cp.Point, ZAxis=brep_cp.Normal)  # disabled
deplane = DeconstructPlane(Plane=pl)  # -> Origin, XAxis, YAxis, ZAxis; disabled
rotate = Rotate(Geometry=deplane.XAxis, Angle=rad, Plane=pl)  # -> Geometry, Transform; disabled

panel_5 = Panel(item)  # disabled

contour = Contour(Shape=item, Point=Point(0, 0, 0), Direction=rotate.Geometry, Distance=num)  # -> simplify(Contours); disabled
number_slider_3 = Slider(0, range=0..100)  # disabled
number_slider_4 = Slider(2, range=0..10)  # disabled
lenth_of_path = Slider(5, range=0..10)  # disabled

trim = TrimTree(Tree=contour, Depth=1)  # disabled

# ----
# Draw Interwoven Infill Pattern
dispatch = Dispatch(List=trim, DispatchPattern=[True, False])  # -> ListA, ListB; disabled
flip = FlipCurve(Curve=dispatch.ListB)  # -> Curve, Flag; disabled
weave = Weave(Pattern=[0, 1], Stream0=dispatch.ListA, Stream1=flip.Curve, NullGaps=False)  # -> simplify(Weave); disabled

disc = Discontinuity(Curve=weave, Level=1)  # -> Points, Parameters; disabled
trim_2 = TrimTree(Tree=disc.Points, Depth=1)  # disabled

cull_i = CullIndex(List=trim_2, Indices=number_slider_3, Wrap=True)  # disabled

trim_3 = TrimTree(Tree=cull_i, Depth=1)  # disabled
partition = PartitionList(List=trim_3, Size=number_slider_4)  # disabled

pline = PolyLine(Vertices=partition, Closed=False)  # disabled

trim_4 = TrimTree(Tree=pline, Depth=1)  # disabled

len = Length(Curve=trim_4)  # disabled
smaller = SmallerThan(FirstNumber=len, SecondNumber=lenth_of_path)  # -> SmallerThan, OrEqualTo; disabled
cull = CullPattern(List=pline, CullPattern=smaller.OrEqualTo)  # disabled

trim_5 = TrimTree(Tree=cull, Depth=1)  # -> simplify(Tree); disabled

join = JoinCurves(Curves=[trim_5, weave], Preserve=False)  # -> simplify(Curves); disabled

flatten = FlattenTree(Tree=join, Path="{0}")  # disabled
unflatten = UnflattenTree(Tree=flatten, Guide=offsets_2)  # disabled
merge_2 = Merge(Data1=unflatten, Data2=merge)  # -> simplify(Result); disabled
graft = GraftTree(Tree=merge_2, IncludeEmptyLists=True, IncludeNullItems=True)  # disabled
panel_6 = Panel(graft)  # disabled
trim_6 = TrimTree(Tree=panel_6, Depth=number_slider)  # disabled
panel_7 = Panel(trim_6)  # disabled
lng = ListLength(List=panel_7)  # disabled
clean = CleanTree(RemoveNulls=True, RemoveInvalid=True, RemoveEmpty=toggle, Tree=merge_2)  # disabled
ma = MassAddition(Input=flatten(lng))  # -> Result, PartialResults; disabled
pr = ClusterOutput(ma.PartialResults)  # disabled
T = ClusterOutput(clean)

# ==== cluster Cluster
radian = ClusterInput()
deg = Degrees(Radians=radian)

# ---- group: Relative Mode Caxis
reldif = RelativeDifferences(Values=radian)
panel = Panel(reldif)
item = ListItem(List=deg, Index=0, Wrap=True)

# ----
deg_2 = Degrees(Radians=panel)
panel_2 = Panel(deg_2)

# ---- group: Relative Mode Caxis / Takes Shortest Rotation
sin = Sine(Value=panel)
asin = ArcSine(Value=sin)
deg_3 = Degrees(Radians=asin)

# ----
c_90_degree_rotation_condition = CSharpScript(x=panel)  # -> out, Rotation, Index; inputs x: list of Double
# ---------- c_90_degree_rotation_condition: C# ----------
    List<double> index = new List<double>();
    List<double> rotation = new List<double>();


    for(int i = 0; i < x.Count; i++){

      if(x[i] < Math.PI && x[i] > Math.PI / 2){
        rotation.Add(x[i]);
        index.Add(i);
      }
      else if(x[i] > -Math.PI && x[i] < -Math.PI / 2){
        rotation.Add(x[i]);
        index.Add(i);
      }
    }
    Rotation = rotation;
    Index = index;
# ---------- end c_90_degree_rotation_condition ----------
deg_4 = Degrees(Radians=c_90_degree_rotation_condition.Rotation)
panel_3 = Panel(c_90_degree_rotation_condition.Index)
panel_4 = Panel(deg_4)

c_180_degree_rotation_condition = CSharpScript(x=panel)  # -> out, Rotation, Index; inputs x: list of Double
# ---------- c_180_degree_rotation_condition: C# ----------
    List<double> index = new List<double>();
    List<double> rotation = new List<double>();

    //if (1 <= x && x <= 100)
    // take in Radian
    for(int i = 0; i < x.Count; i++){

      if(Math.PI - 1 <= x[i] && x[i] <= Math.PI + 1){
        rotation.Add(x[i]); //output Degree
        index.Add(i);
      }
      else if(-Math.PI - 1 <= x[i] && x[i] <= -Math.PI + 1){
        rotation.Add(x[i]); //ouput degree
        index.Add(i);
      }
    }
    Rotation = rotation;
    Index = index;
# ---------- end c_180_degree_rotation_condition ----------
panel_5 = Panel(c_180_degree_rotation_condition.Index)
panel_6 = Panel(c_180_degree_rotation_condition.Rotation)

deg_5 = Degrees(Radians=c_180_degree_rotation_condition.Rotation)

# ---- group: Relative Mode Caxis (continued)
replace = ReplaceItems(List=deg_3, Item=item, Indices=Slider(0, range=0..100), Wrap=False)

# ----
replace_2 = ReplaceItems(List=replace, Item=deg_5, Indices=c_180_degree_rotation_condition.Index, Wrap=False)

panel_7 = Panel(replace_2)
replace_3 = ReplaceItems(List=replace_2, Item=panel_4, Indices=panel_3, Wrap=False)

# ---- group: Relative Mode Caxis (continued)
panel_8 = Panel(replace_3)
ma = MassAddition(Input=panel_8)  # -> Result, PartialResults

# ----
panel_9 = Panel(replace_3)
L = ClusterOutput(replace_3)
deg_6 = Degrees(Radians=ma.PartialResults)
pr = ClusterOutput(ma.PartialResults)
panel_10 = Panel(ma.PartialResults)

# ==== cluster ClusterReplaceVectorLength
V = ClusterInput()
A = ClusterInput()
T = ClusterInput()
subtraction = Subtraction(A=A, B=Slider(1, range=0..1))
panel = Panel(V)
number_slider = Slider(0, range=0..100)
amp = Amplitude(Vector=V, Amplitude=Slider(20, range=0..100))  # -> flatten(Vector)
flatten = FlattenTree(Tree=T, Path="{0}")
ins = InsertItems(List=subtraction, Item=number_slider, Indices=number_slider, Wrap=True)
panel_2 = Panel(amp)
item = ListItem(List=amp, Index=ins, Wrap=True)
panel_3 = Panel(item)
panel_4 = Panel(flatten)
replace = ReplaceItems(List=flatten, Item=item, Indices=ins, Wrap=False)
unflatten = UnflattenTree(Tree=replace, Guide=T)
panel_5 = Panel(replace)
T_2 = ClusterOutput(unflatten)

# ==== cluster ClusterFindingNormalFromGuidePoint
B = ClusterInput()
layer_height = ClusterInput()
A = ClusterInput()
debrep = DeconstructBrep(Brep=B)  # -> Faces, Edges, Vertices
center = Center(Geometric=debrep.Faces)  # -> Center, Dimension
srf = Surface(debrep.Faces)

# ---- group: This is to find a cloest surface to the substrate
dist = Distance(PointA=A, PointB=center.Center)
c_script = CSharpScript(x=dist)  # -> out, max, min, minI, maxI; inputs x: list of Double
# ---------- c_script: C# ----------
    double maxValue = x.Max();
    double minValue = x.Min();

    double minIndex = x.ToList().IndexOf(minValue);
    double maxIndex = x.ToList().IndexOf(maxValue);

    max = maxValue;
    min = minValue;

    minI = minIndex;
    maxI = maxIndex;
# ---------- end c_script ----------

# ---- group: We extend and offset surface to achieve non-planar contouring
number_slider = Slider(20, range=0..10000)
item = ListItem(List=srf, Index=c_script.minI, Wrap=True)
c_script_2 = CSharpScript(surface=item, north=number_slider, east=number_slider, south=number_slider, west=number_slider)  # -> out, A; inputs surface: Surface, north: Double, east: Double, south: Double, west: Double
# ---------- c_script_2: C# ----------
    if (north != 0)
      surface = surface.Extend(IsoStatus.North, north, true);
    if (east != 0)
      surface = surface.Extend(IsoStatus.East, east, true);
    if (south != 0)
      surface = surface.Extend(IsoStatus.South, south, true);
    if (west != 0)
      surface = surface.Extend(IsoStatus.West, west, true);
    A = surface;
# ---------- end c_script_2 ----------

# ---- group: Last layer
item_2 = ListItem(List=srf, Index=c_script.maxI, Wrap=True)

# ----
increase_this_number_hardcode = Slider(1.5, range=0..10)
planar = IsPlanar(Surface=item, Interior=True)  # -> Planar, Plane
planar_2 = IsPlanar(Surface=item_2, Interior=True)  # -> Planar, Plane
dist_2 = Distance(PointA=planar.Plane, PointB=planar_2.Plane)
multiplication = Multiplication(A=dist_2, B=increase_this_number_hardcode)
division = Division(A=multiplication, B=layer_height)

series = Series(Start=layer_height, Step=layer_height, Count=division)
offset = OffsetSurface(Surface=c_script_2.A, Distance=series, Retrim=True)
toggle = BooleanToggle(True)
bbx = BrepBrep(BrepA=B, BrepB=offset)  # -> Curves, Points
clean = CleanTree(RemoveNulls=True, RemoveInvalid=toggle, RemoveEmpty=toggle, Tree=bbx.Curves)
disc = Discontinuity(Curve=clean, Level=1)  # -> Points, Parameters
shatter = Shatter(Curve=clean, Parameters=disc.Parameters)
autoedgsrf = AutomaticEdgeSurface(Edges=shatter)
panel = Panel(clean)
panel_2 = Panel(autoedgsrf)
curve = ClusterOutput(clean)
A_2 = ClusterOutput(autoedgsrf)
